# Grasshopper definition FDM_overview.gh (Grasshopper 1.0.8)
# plug-ins: Toolpaths.Fdm

list = ValueList({"Cross-section Area": 0, "Auto Width": 1, "Auto Ratio": 2, "Static": 3, "No Extrusion": 4}, selected="Cross-section Area")
geo = Geometry(<curve referenced from the Rhino model>)
fdm_toolpath = FDMToolpath(Curve=geo, EMode=list, ECrossSection=Slider(38, range=0..100))
fdm_operation = FDMOperation(Toolpaths=fdm_toolpath)
panel = Panel("""1
1.2""")
number = Number(1.75)
_3 = Number(2)
mod_flow = ModulatorFlow(Input=fdm_operation, Scales=panel, VertexMappingStrategy=2)
fdmdefaults = FDMDefaults(FilamentDiameter=number, NozzleDiameter=_3)
fdm_machine = FDMMachine(ToolpathsOperations=mod_flow, Defaults=fdmdefaults, HFTime=-1)  # -> SimulationData, Errors, Warnings, HFPoints, SamplePoints, SampleHeights, TripleProbeTree
warnings = Panel(fdm_machine.Warnings)
errors = Panel(fdm_machine.Errors)
list_2 = ValueList({"Klipper": "klipper", "RepRap": "reprap", "Prusa": "prusa"}, selected="Klipper")
path = FilePath("C:\Users\konra\Downloads\")
fdm_g_code = FDMGCodeOutput(
    SimulationData=fdm_machine.SimulationData,
    MachineType=list_2,
    OutputDirectory=path,
    Save=Button(),
    Upload=Button(),
    PrinterIPAddress="192.168.0.34",
    StartPrint=Toggle(False))  # -> GCode, Toolpath, VerboseDebug, ToolpathDebug
fdm_sim = FDMSimulator(
    SimulationData=fdm_machine.SimulationData,
    Time=Slider(0.66, range=0..1),
    Play=Toggle(False),
    Speed=1,
    MaxFPS=30,
    StadiumSegments=10,
    BakeMeshes=False)  # -> CurrentTime, Meshes, ToolPosition
