# Grasshopper definition TP-stoneFlower.gh (Grasshopper 1.0.8)
# plug-ins: Toolpaths.Fdm

xy = XYPlane(Origin=Point(0, 0, 0))
cyl = Cylinder(Base=PlaneXY(0, 0, 0), Radius=Slider(18, range=0..100), Length=Slider(41, range=0..100))
fdm_vase = FDMVaseModeGenerator(Geometry=cyl, Center=xy, Divisions=24, AlternatingPattern=True, LayerHeight=Slider(1, range=0..1))  # -> Toolpath, StartContours, EndContours

number_slider = Slider(100, range=0..100)
Y = UnitY(Factor=number_slider)
X = UnitX(Factor=number_slider)
addition = Addition(A=Y, B=X)
move = Move(Geometry=fdm_vase.Toolpath, Motion=addition)  # -> Geometry, Transform

panel = Panel("""G91 ; relative positioning
G1 Z+3  F3000 ; move Z up a bit and retract filament even more
G1 XO YO ; move X/Y to min endstops, so the head is out of the way
M84 ; steppers off
G90 ; absolute positioning""")
panel_2 = Panel("""M92 E67.670000 ; number of steps per mm of filament 
G21;metric values
G90; absolute positioning
M82;set extruder to absolute mode
M107; start with the fan off
M302 P1; allow cold extrusion
G28 XO YO;move X/Y to min endstops
G28 20; move Z to min endstops
G92 20; set current Z as zero
G1 215.0 F3000 ; move the platform down 15mm
G92 E0;zero the extruded length
G1 F300 E3.0; extrude 3 mm of feed stock
G92 E0;zero the extruded length again
G1 F3000""")

list = ValueList({"Cross-section Area": 0, "Auto Width": 1, "Auto Ratio": 2, "Static": 3, "No Extrusion": 4}, selected="Cross-section Area")
fdm_toolpath = FDMToolpath(Curve=move.Geometry, EMode=list, ECrossSection=Slider(1.6, range=0..10))

startcode = Text(panel_2)
endcode = Text(panel)
fdmdefaults = FDMDefaults(StartGCode=startcode, EndGCode=endcode)
fdm_machine = FDMMachine(ToolpathsOperations=fdm_toolpath, Defaults=fdmdefaults, HFTime=-1, DebugOutputs=False)  # -> SimulationData, Errors, Warnings, HFPoints, SamplePoints, SampleHeights, TripleProbeTree
list_2 = ValueList({"Klipper": "klipper", "RepRap": "reprap", "Prusa": "prusa", "Bambu": "bambu"}, selected="RepRap")
path = FilePath()
fdm_g_code = FDMGCodeOutput(
    SimulationData=fdm_machine.SimulationData,
    MachineType=list_2,
    Save=Button(),
    Upload=Button(),
    PrinterIPAddress="192.168.178.254",
    StartPrint=Toggle(True))  # -> GCode, Toolpath, Info, VerboseDebug, ToolpathDebug
fdm_sim = FDMSimulator(
    SimulationData=fdm_machine.SimulationData,
    Time=Slider(0.435, range=0..1),
    Play=False,
    Speed=1,
    MaxFPS=30,
    StadiumSegments=4,
    BakeMeshes=False)  # -> CurrentTime, Meshes, ToolPosition
