# Grasshopper definition toolpath_flow-modulator_beta-24.gh (Grasshopper 1.0.8)
# plug-ins: Toolpaths.Fdm, Toolpaths.Gh

# ----
# input geometry: cylinder
number_slider = Slider(40, range=0..100)
# TOOLPATHS
# developed by JÜNGERKÜHN
# contact: toolpaths@juengerkuehn.com
# juengerkuehn.com
# github.com/KonradJuenger/TOOLPATHS
xy = XYPlane(Origin=Point(0, 0, 0))
cyl = Cylinder(Base=xy, Radius=number_slider, Length=Slider(130, range=0..1000))

layerheight = Slider(3, range=0..10)
layerheight_2 = Number(layerheight)
number_slider_2 = Slider(0.4, range=0..1)
mode = Mode({"Angle": 0, "Length": 1}, selected="Angle")
# vase mode
layerheight_3 = Number(layerheight_2)
vase_options = FDMVaseOptions(SamplingMode=mode, Divisions=Slider(106, range=0..1000), BaseThickness=Slider(0.2, range=0..1), FadeStart=Toggle(True))
fdm_vase = FDMVaseModeGenerator(Geometry=cyl, LayerHeight=layerheight_3, ExtrusionWidth=Slider(3, range=0..10), Options=vase_options)  # -> Toolpath, HelixCurve, UnsampledCurve, TopCurves, BottomCurves

# ----
# mask modulator
geo = Geometry(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)
len = Length(Curve=geo)
maskgradient = MaskGradient(Input=fdm_vase.Toolpath, Mode=0, Base=geo, Wavelength=len)

# ----
# modulate flow
panel = Panel("""0.1
0.1
1
1""")
mod_flow = ModulatorFlow(Input=fdm_vase.Toolpath, Scales=panel, VertexMappingStrategy=2, Mask=maskgradient)

# ----
# process settings
number_slider_3 = Slider(0.3, range=0..1)
# machine settings
number_slider_4 = Slider(5, range=0..10)
defaults = FDMDefaults(
    HeightfieldResolution=number_slider_3,
    SafeClearance=Slider(6, range=0..10),
    ZHopHeight=Slider(2, range=0..10),
    MeshingResolution=Slider(0.4, range=0..1),
    SmoothingWindow=Slider(1, range=0..100),
    DegenerateAspectRatio=Slider(20, range=0..100),
    MinLayerHeight=Slider(0.1, range=0..0.1),
    MaxLayerHeight=number_slider_4)

extruder = FDMExtruder(
    ExtruderNumber=0,
    NozzleDiameter=Slider(2, range=0..10),
    FilamentDiameter=1.75,
    PrintMaterial=ColourSwatch(SwatchColor=RGB(135, 147, 237)))
box = Box({Plane=Plane(origin=(0, 300, 0), x=(1, 0, 0), y=(0, -1, 0)), X=Domain(0, 300), Y=Domain(0, 300), Z=Domain(-400, 0)})
machine = FDMMachine(
    G0RapidSpeed=200,
    MaxZSpeed=6,
    MachineBounds=box,
    Extruders=extruder,
    EPosAbsRel=0,
    HomeBeforePrint=False,
    CenterPrintXY=Toggle(True))

mode_2 = ProcessorMode({"Hybrid": 2, "Preview": 1, "Simulation": 0}, selected="Hybrid")
processor = FDMProcessor(Toolpaths=mod_flow, Machine=defaults, Defaults=machine, ProcessorMode=mode_2)  # -> SimulationData, Errors, Warnings

# ----
# use the color componet to define custom colors
swatch = ColourSwatch(SwatchColor=RGB(252, 254, 255))
colors = Colors(FDMTravel=swatch)

# ----
# FDM simulator creates a scrubbable preview from all processed toolpaths
toggle = BooleanToggle(False)
# SIMULATE + GCODE
number_slider_5 = Slider(1, range=0..1)
fdm_sim = FDMSimulator(
    SimulationData=processor.SimulationData,
    Time=number_slider_5,
    Play=toggle,
    Speed=1,
    StadiumSegments=3,
    BakeMeshes=False,
    Colors=colors,
    ProgressOverlay=True,
    DisablePreview=False)  # -> CurrentTime, Meshes, ToolPosition, ProgramDuration

number_slider_6 = Slider(1, range=0.3..3)
