# Grasshopper definition toolpath_image_map-beta6.gh (Grasshopper 1.0.8)
# plug-ins: Toolpaths.Fdm, Toolpaths.Gh

# ----
# TOOLPATHS
# developed by JÜNGERKÜHN
# contact: toolpaths@juengerkuehn.com
# juengerkuehn.com
# github.com/KonradJuenger/GH_toolpaths
# create base geometry
geo = Geometry(<curve referenced from the Rhino model>)
geo_2 = Geometry(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)
revsrf = Revolution(Curve=geo, Axis=geo_2, Domain=Domain(0, 6.283185307))

# ----
# vase mode spiral path
number_slider = Slider(120, range=0..1000)
fdm_vase = FDMVaseModeGenerator(
    Geometry=revsrf,
    LayerHeight=Slider(1.5, range=0..10),
    Divisions=number_slider,
    AlternatingPattern=Toggle(True),
    ShiftStart=Slider(0.7, range=0..1))  # -> Curves, StartCurves, EndCurves

# ----
# create toolpath object
# with auto width
e_mode = EMode({"Volume": 0, "Auto Width": 1, "Auto Ratio": 2, "Static": 3, "No Extrusion": 4}, selected="Auto Width")

fdm_toolpath = FDMToolpath(Curve=fdm_vase.Curves, EMode=e_mode, Volume=Slider(1.27, range=0..10), EWidth=Slider(4.839, range=0..10))

bbox = BoundingBox(Content=fdm_toolpath, Plane=PlaneXY(0, 0, 0), UnionBox=True)  # -> Box, Box_2
volume = Volume(Geometry=bbox.Box)  # -> Volume, Centroid
# bounding cylinder
debox = DeconstructBox(Box=bbox.Box)  # -> Plane, X, Y, Z
pdecon = Deconstruct(Point=volume.Centroid)  # -> XComponent, YComponent, ZComponent
dedomain = DeconstructDomain(Domain=debox.X)  # -> Start, End
dedomain_2 = DeconstructDomain(Domain=debox.Y)  # -> Start, End
dedomain_3 = DeconstructDomain(Domain=debox.Z)  # -> Start, End
subtraction = Subtraction(A=dedomain_2.End, B=dedomain_2.Start)
subtraction_2 = Subtraction(A=dedomain.End, B=dedomain.Start)
subtraction_3 = Subtraction(A=dedomain_3.End, B=dedomain_3.Start)
pt = ConstructPoint(XCoordinate=pdecon.XComponent, YCoordinate=pdecon.YComponent, ZCoordinate=0)
max = Maximum(A=subtraction_2, B=subtraction)
xy = XYPlane(Origin=pt)
cyl = Cylinder(Base=xy, Radius=max, Length=subtraction_3)

# ----
# get the brightness values of the corresponding vert / pixel pairs
decon_fdm = DeconstructFDMToolpath(Toolpath=fdm_toolpath)  # -> Path, Vertices
srf_cp = SurfaceClosestPoint(Point=decon_fdm.Vertices, Surface=reparameterize(cyl))  # -> Point, UVPoint, Distance
vec = VectorXYZ(XComponent=Slider(1, range=0..10), YComponent=Slider(0.4, range=0..1), ZComponent=0)  # -> Vector, Length
multiplication = Multiplication(A=srf_cp.UVPoint, B=vec.Vector)
image = ImageSampler(
    multiplication,
    FilePath="D:\01_Projekte\00_current_projects\JK_toolpaths\Substance_graph_output_4.png",
    Filter="Value",
    Interpolate=False,
    Umax=1,
    Umin=0,
    Vmax=1,
    Vmin=0,
    Wrap=1)

number_slider_2 = Slider(4, range=0..10)

# ----
# use the pixel bightness as a modulator
neg = Negative(Value=number_slider_2)
dom = ConstructDomain(DomainStart=neg, DomainEnd=number_slider_2)
remap = RemapNumbers(Value=image, Source=Domain(0, 1), Target=dom)  # -> Mapped, Clipped
mod_ndisp = ModulatorNormalDisplacement(Input=fdm_toolpath, Distances=remap.Mapped, VertexMappingStrategy=2, Mode=0)

fdmdefaults = FDMDefaults(
    HeightfieldResolution=Slider(0.2, range=0..1),
    NozzleDiameter=Slider(2, range=0..10),
    MeshingResolution=Slider(0.5, range=0..1),
    SmoothingWindow=Slider(10, range=0..10),
    DegenerateAspectRatio=Slider(6, range=0..10),
    MinLayerHeight=Slider(0.1, range=0..0.1),
    MaxLayerHeight=Slider(2.021, range=0..10))
fdm_machine = FDMMachine(ToolpathsOperations=mod_ndisp, Defaults=fdmdefaults, HFTime=-1, DebugOutputs=False)  # -> SimulationData, Errors, Warnings, HFPoints, SamplePoints, SampleHeights, TripleProbeTree
fdm_sim = FDMSimulator(SimulationData=fdm_machine.SimulationData, Time=1, Play=False, Speed=1, StadiumSegments=3, BakeMeshes=False)  # -> CurrentTime, Meshes, ToolPosition
