# Grasshopper definition toolpath_robot-output_beta-24.gh (Grasshopper 1.0.8)
# plug-ins: Robots, Toolpaths.Fdm

extruder = FDMExtruder(ExtruderNumber=0, NozzleDiameter=Slider(4, range=0..10), FilamentDiameter=1.75, PrintMaterial=RGB(100, 149, 237))
machine = FDMMachine(
    G0RapidSpeed=200,
    MaxZSpeed=6,
    Extruders=extruder,
    EPosAbsRel=Slider(1, range=0..1),
    HomeBeforePrint=False,
    CenterPrintXY=Toggle(False))

# ----
# TOOLPATHS
# developed by JÜNGERKÜHN
# contact: toolpaths@juengerkuehn.com
# juengerkuehn.com
# github.com/KonradJuenger/TOOLPATHS
geo = Geometry([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])
fdm_toolpath = FDMToolpath(Curve=geo, Volume=Slider(3, range=0..10))

defaults = FDMDefaults(ZHopHeight=Slider(50, range=0..100), SafeClearance=Slider(80, range=0..100))

mode = ProcessorMode({"Hybrid": 2, "Preview": 1, "Simulation": 0}, selected="Hybrid")
# change the robots orientation to tilt the tool
processor = FDMProcessor(Toolpaths=fdm_toolpath, Machine=machine, Defaults=defaults, ProcessorMode=mode)  # -> SimulationData, Errors, Warnings

fdmrobot = FDMRobotsOutput(SimulationData=processor.SimulationData, Orientation=Slider(1, range=0..10), Behavior=1)  # -> Planes, Speeds, Extrusion, ExtrusionSpeed, Types

# ----
# tcp
# tool oriented sideways
# to avoid wrist singularity
panel = Panel("0,0,1")
tool_weight = Panel("5.0")
pt = Point(Point(137.8363948, 2.467293384e-06, 44.59797803))
mesh = Mesh(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)
tool_name = Panel("Extruder")
pl = ConstructPlane(Origin=pt, XAxis="0,1,0", YAxis=panel)
tool = CreateTool(Name=tool_name, TCP=pl, Weight=tool_weight, Mesh=mesh)  # -> Tool, TCP

list = RobotsLibrary({"UR3e", "UR5e", "UR10e", "UR16e", "UR3", "UR5", "UR10", "UR20", "UR30"}, selected="UR5e", Type=0)
list_2 = FlagFields({"Shoulder": 1, "Elbow": 2, "Wrist": 4}, selected="Wrist")
list_3 = ValueList({"Joint", "Linear", "Process"}, selected="Linear")
createtarget = CreateTarget(Plane=fdmrobot.Planes, Configuration=list_2, Motion=list_3, Tool=tool.Tool, Speed=fdmrobot.Speeds, IsCartesian=True)
loadrobot = LoadRobotSystem(Name=list, Base=PlaneXY(0, 0, 0))
program = CreateProgram(Name="DefaultProgram", RobotSystem=loadrobot, Targets=createtarget, StepSize=1)  # -> Program, Code, Duration, Warnings, Errors
number_slider = Slider(0.81103, range=0..1)
sim = ProgramSimulation(Program=program.Program, Time=number_slider, Normalized=True)  # -> SystemMeshes, JointRotations, Plane, Index, Time, Program, Errors
fdm_sim = FDMSimulator(
    SimulationData=processor.SimulationData,
    Time=number_slider,
    Play=False,
    Speed=1,
    StadiumSegments=3,
    BakeMeshes=False,
    ProgressOverlay=True,
    DisablePreview=False)  # -> CurrentTime, Meshes, ToolPosition, ProgramDuration
