# Grasshopper definition toolpath_showcase_beta-2.gh (Grasshopper 1.0.8)
# plug-ins: Toolpaths.Fdm, Toolpaths.Gh

xy = XYPlane(Origin=Point(244.3094513, 21.29128915, 0))
# variable layer heigh based on slope
geo = Geometry(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)
line = LineSDL(Start=xy, Direction=Vector(0, 0, 1), Length=1)
_1 = Mode(1)
revsrf = Revolution(Curve=geo, Axis=line, Domain=Domain(0, 6.283185307))
lh_gen = FDMLayerHeightGenerator(Mode=_1, Curve=geo, MinHeight=Slider(0.2, range=0..1), MaxHeight=Slider(1, range=0..10), Normalize=Toggle(True))
fdm_vase = FDMVaseModeGenerator(Geometry=revsrf, LayerHeight=1, LayerHeightField=lh_gen, Divisions=24, AlternatingPattern=False)  # -> Curves, StartCurves, EndCurves
fdm_toolpath = FDMToolpath(Curve=fdm_vase.Curves, EWidth=Slider(2, range=0..10))

# ----
# variable layer heigh based on explicit values
# define a sequence of layerheights to interpolate
panel = Panel("""1.7
0.3
1.7
0.3
1.7
0.3""")
_0 = Mode(0)
lh_gen_2 = FDMLayerHeightGenerator(Mode=_0, LayerHeights=panel, MinHeight=0.1, MaxHeight=0.4)
geo_2 = Geometry(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)
fdm_vase_2 = FDMVaseModeGenerator(Geometry=geo_2, LayerHeight=1, LayerHeightField=lh_gen_2, Divisions=24, AlternatingPattern=False)  # -> Curves, StartCurves, EndCurves
fdm_toolpath_2 = FDMToolpath(Curve=fdm_vase_2.Curves, EWidth=Slider(2, range=0..10))

# ----
# vase mode
geo_3 = Geometry(Point(207.8120414, 24.6220849, 0))

# ----
# base geometry
number_slider = Slider(10, range=0..100)
xy_2 = XYPlane(Origin=geo_3)
cyl = Cylinder(Base=xy_2, Radius=number_slider, Length=Slider(23, range=0..100))

linewidths = Panel("""1
2
1
1.5
2""")

# ----
# input should be a closed planar polyling
# output is a series of inner offsets
# first offset is 0.5*linewidth
# subsequent are n*linewidth
# infill curve is the inner most wall;
# area to be filled with infill
# infill offset shifts the infill region towards / away from the walls
number_slider_2 = Slider(2, range=0..10)
# wall generation (different widths)
number_slider_3 = Slider(0.3, range=0..1)
# TOOLPATHS
# developed by JÜNGERKÜHN
# contact: toolpaths@juengerkuehn.com
# juengerkuehn.com
# github.com/KonradJuenger/GH_toolpaths
# CURVE GENERATION
# wall generation
geo_4 = Geometry(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)
fdm_walls = FDMWallsGenerator(Curves=geo_4, LineWidth=number_slider_2, Count=Slider(4, range=0..10), InfillOffset=number_slider_3)  # -> Curves, InfillCurves
geo_5 = Geometry(fdm_walls.Curves)
geo_6 = Geometry(fdm_walls.InfillCurves)
fdm_toolpath_3 = FDMToolpath(Curve=geo_5, EWidth=number_slider_2)

panel_2 = Panel("""1.7
0.5
1.7""")

# ----
# variable layer height and shifted postions
# by defining the positions (0..1) of the
# supplied layerheights it is possible to shift
# areas up and down
number_slider_4 = Slider(0.6912, range=0.2..0.9)
_1_2 = Number(1)
_0_2 = Number(0)
merge = Merge(Data1=_0_2, Data2=number_slider_4, Data3=_1_2)
_0_3 = Mode(0)
lh_gen_3 = FDMLayerHeightGenerator(Mode=_0_3, LayerHeights=panel_2, Distribution=merge, MinHeight=0.1, MaxHeight=0.4)
geo_7 = Geometry(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)
fdm_vase_3 = FDMVaseModeGenerator(Geometry=geo_7, LayerHeight=1, LayerHeightField=lh_gen_3, Divisions=24, AlternatingPattern=False)  # -> Curves, StartCurves, EndCurves
fdm_toolpath_4 = FDMToolpath(Curve=fdm_vase_3.Curves, EWidth=Slider(2, range=0..10))

# ----
# to get the offsets from linewidths:
# (Sum of all previous linewidths) + (Half of current linewidth)
ma = MassAddition(Input=linewidths)  # -> Result, PartialResults
_0_4 = Integer(0)
_2 = Integer(2)
division = Division(A=linewidths, B=_2)
ins = InsertItems(List=ma.PartialResults, Item=_0_4, Indices=_0_4, Wrap=True)
addition = Addition(A=ins, B=division)
short = ShortestList(ListA=addition, ListB=division, TrimMode=2)  # -> ListA, ListB

# ----
# manual offsets can be used to create walls with different thicknesses
# (right click to reveal the input)
geo_8 = Geometry(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)
fdm_walls_2 = FDMWallsGenerator(Curves=geo_8, LineWidth=1, Count=1, InfillOffset=0, ManualOffsets=short.ListA)  # -> Curves, InfillCurves
fdm_toolpath_5 = FDMToolpath(Curve=fdm_walls_2.Curves, EWidth=linewidths)

# ----
# extrusion modes
# "static" defines the size explicitly with width, height
e_mode = EMode({"E Area": 0, "Auto Width": 1, "Auto Ratio": 2, "Static": 3, "No Extrusion": 4}, selected="Static")
geo_9 = Geometry(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)
fdm_toolpath_6 = FDMToolpath(Curve=geo_9, EMode=e_mode, EWidth=Slider(2, range=0..10), EHeight=Slider(1, range=0..10))

# ----
# "volume" defines the amount of material extruded per millimeter of travel. (mm^3/mm)
# Another way to say it is that this is the cross-section area of the extrusion
e_mode_2 = EMode({"Volume": 0, "Auto Width": 1, "Auto Ratio": 2, "Static": 3, "No Extrusion": 4}, selected="Volume")
# "auto width" adjust the amount of material extruded to achive a target width.
# it does so my checking agains all other extrusions in the program
number_slider_5 = Slider(2.3, range=0..5)
geo_10 = Geometry(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)
fdm_toolpath_7 = FDMToolpath(Curve=geo_10, EMode=e_mode_2, Volume=number_slider_5)

e_mode_3 = EMode({"E Area": 0, "Auto Width": 1, "Auto Ratio": 2, "Static": 3, "No Extrusion": 4}, selected="Auto Width")
# "auto ratio" works the same way as auto
#  with but adjust the material to get to a specified width/heigth ratio
number_slider_6 = Slider(2.1, range=0..4)
geo_11 = Geometry(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)
fdm_toolpath_8 = FDMToolpath(Curve=geo_11, EMode=e_mode_3, EWidth=number_slider_6)

# ----
# toolpath options
# extend at start / end will dynamically extend the toolpath by the given distance.
# closed curves will loop around -- open curves will extend along the tangent
geo_12 = Geometry([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])
fdm_toolpath_9 = FDMToolpath(Curve=geo_12, ExtendAtStart=Slider(1.936, range=0..10), ExtendAtEnd=Slider(2.716, range=0..10))

e_mode_4 = EMode({"E Area": 0, "Auto Width": 1, "Auto Ratio": 2, "Static": 3, "No Extrusion": 4}, selected="Auto Ratio")
geo_13 = Geometry(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)
fdm_toolpath_10 = FDMToolpath(Curve=geo_13, EMode=e_mode_4, ERatio=Slider(3.04, range=0..10))

# ----
# retract specifies the amount of material retracted into the nozzle at the end of the toolpath. this prevents oozing.
geo_14 = Geometry(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)
fdm_toolpath_11 = FDMToolpath(Curve=geo_14, Retraction=Slider(1.3, range=0..10))

# ----
# "no extrusion" will not extrude any material
e_mode_5 = EMode({"E Area": 0, "Auto Width": 1, "Auto Ratio": 2, "Static": 3, "No Extrusion": 4}, selected="No Extrusion")
geo_15 = Geometry(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)
fdm_toolpath_12 = FDMToolpath(Curve=geo_15, EMode=e_mode_5)

# ----
# "speed" specifies the velocity of the toolpath in mm/s
geo_16 = Geometry(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)
fdm_toolpath_13 = FDMToolpath(Curve=geo_16, Speed=Slider(60, range=0..100))

# ----
# "z axis speed" is the speed used for movents in the z axis
geo_17 = Geometry(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)
# "commands" can be executed before or after the toolpath move. use CmdPre / Post respectively
number_slider_7 = Slider(18, range=0..100)
# Hint: comands can be grouped into one object
fdm_toolpath_14 = FDMToolpath(Curve=geo_17, ZAxisSpeed=number_slider_7)

# ----
# Hint: while static mode is the most intuitive, in 3d printing the
# height of the extrusion is not a property that can be influenced directly.
# The height is rather the distance to the last layer.
# TOOLPATHS simulates the extrusion process so that height is
# derived form a heightfield containing all extrusions.
number_slider_8 = Slider(3.2, range=0..10)
# Hint: when possible the correct mode is selected automatically
geo_18 = Geometry(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)
fdm_toolpath_15 = FDMToolpath(Curve=geo_18, EWidth=number_slider_8)

# ----
# zhop specifies a movement in Z at the end of the toolpath. it prevents collisions with the printed material
geo_19 = Geometry(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)
fdm_toolpath_16 = FDMToolpath(Curve=geo_19, ZHop=Slider(7.29, range=0..10))

# ----
# "temperature" sets the nozzle or bed temperature
geo_20 = Geometry(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)
fdm_toolpath_17 = FDMToolpath(Curve=geo_20, ExtruderTemperature=Slider(200, range=0..1000), BedTemperature=Slider(60, range=0..100))

# ----
# use the volume component to calculate the volume
# needed for a specific extrusion width / height
number_slider_9 = Slider(1, range=0..10)
geo_21 = Geometry(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)
extrvolume = FDMExtrusionVolume(Width=Slider(1.508, range=0..10), Height=number_slider_9)
fdm_toolpath_18 = FDMToolpath(Curve=geo_21, Volume=extrvolume)

# ----
# "flow" acts as a multiplier on top of the other modes
# it can also be used to increase the material in auto width mode
geo_22 = Geometry(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)
fdm_toolpath_19 = FDMToolpath(Curve=geo_22, EWidth=Slider(1, range=0..10), Flow=Slider(2.9, range=0..10))

# ----
# toolpath object are still grasshopper geometry
# and can be copied with standart geometry operations
geo_23 = Geometry(Point(16.74433711, 73.13769757, 0))

# ----
# toolpath object
geo_24 = Geometry(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)
_2_2 = Integer(2)
# TOOLPATHS
fdm_toolpath_20 = FDMToolpath(Curve=geo_24, EWidth=_2_2)
# works even with complex transforms
number_slider_10 = Slider(5, range=0..10)
xy_3 = XYPlane(Origin=geo_23)
arrpolar = PolarArray(Geometry=fdm_toolpath_20, Plane=xy_3, Count=number_slider_10, Angle=6.283185307)  # -> Geometry, Transform

geo_25 = Geometry(Point(44.01161679, 71.96222899, 0))

# ----
# maelstrom does the thing
# toolpaths is defined as a line
number_slider_11 = Slider(1.1, range=0..10)
geo_26 = Geometry(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)
fdm_toolpath_21 = FDMToolpath(Curve=geo_26, EWidth=number_slider_11)
xy_4 = XYPlane(Origin=geo_25)
pi = Pi(Factor=Slider(4.49, range=0..6))
maelstrom = Maelstrom(Geometry=fdm_toolpath_21, Plane=xy_4, First=0.1, Second=10, Angle=pi, Rigid=False)

# ----
# select column to preview
list = ValueList({"CURVE GENERATION": 0, "TOOLPATH OPTIONS": 1, "SETTINGS HIERARCHY": 2, "FDM DEFAULTS": 3, "MODULATORS": 4, "MASKS": 5}, selected="CURVE GENERATION")

# ----
# Operations can sort toolpaths. ( TSP)
# Toolpaths are only sorted within the same operation, never across different operations.
# Sorting can optionally flip curves to reduce travel distance and shorten the path.
toggle = BooleanToggle(True)

# ----
# toolpath operations
geo_27 = Geometry(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)
# mutliple toolpaths can be grouped into one operation
pop2d = Populate2D(Region=geo_27, Count=Slider(25, range=1..25), Seed=1)
line_2 = LineSDL(Start=pop2d, Direction=Vector(28.85115293, 20.90869762, 0), Length=Slider(2, range=0..10))
# An operation groups toolpaths together.
fdm_toolpath_22 = FDMToolpath(Curve=line_2, EWidth=Slider(2, range=0..10))
fdm_operation = FDMOperation(Toolpaths=fdm_toolpath_22, SortCurves=toggle)

merge_2 = Merge(
    Data1=fdm_toolpath_6,
    Data2=fdm_toolpath_7,
    Data3=fdm_toolpath_8,
    Data4=fdm_toolpath_10,
    Data5=fdm_toolpath_12,
    Data6=fdm_toolpath_15,
    Data7=fdm_toolpath_18,
    Data8=fdm_toolpath_19)
merge_3 = Merge(Data1=flatten(arrpolar.Geometry), Data2=flatten(maelstrom))

# ----
# in this example the zHop will be 2mm as it falls back to the value specified in the default component
geo_28 = Geometry(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)
fdm_toolpath_23 = FDMToolpath(Curve=geo_28)  # -> flatten(Toolpath)

geo_29 = Geometry(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)
fdm_toolpath_24 = FDMToolpath(Curve=geo_29, ZHop=Slider(0.6, range=0..5))

geo_30 = Geometry(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)
fdm_toolpath_25 = FDMToolpath(Curve=geo_30, ZHop=Slider(4.9, range=0..5))

geo_31 = Geometry(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)
fdm_toolpath_26 = FDMToolpath(Curve=geo_31, ZHop=Slider(1.2, range=0..5))

geo_32 = Geometry(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)
fdm_toolpath_27 = FDMToolpath(Curve=geo_32, ZHop=Slider(4.1, range=0..5))

# ----
# toolpaths properties are applied at three hierachry levels:
# Defaults (lowest), Toolpath, and Operation (highest).
# Set a global default once, override it on a few toolpaths,
# or apply changes to an entire operation
# without duplicating inputs.
# properties at the default level are used as a fallback.
# if no other setting is applied the default value is used.
number_slider_12 = Slider(0.5, range=0..1)

# ----
# in this example the zhop will be 0.6mm for the first toolpath and 4.9mm for the second
# as the operations does not specify
#  a new zhop value all toolpath preserve their value
relay = Relay([fdm_toolpath_24, fdm_toolpath_25])
fdm_operation_2 = FDMOperation(Toolpaths=relay)

# ----
# in this example the zhop will be 3.2mm as the operation overwrites all other settings
# toolpaths can be gouped in operations.
# properties can be set on a per toolpath level
# properties set at operation level overwrite
# toolpath properties and defaults
# properties set at toolpath level overwrite
# defaults
relay_2 = Relay([fdm_toolpath_26, fdm_toolpath_27])

fdm_operation_3 = FDMOperation(Toolpaths=relay_2, ZHop=Slider(3.2, range=0..5))

fdmdefaults = FDMDefaults(
    HeightfieldResolution=number_slider_12,
    InitZHeight=Slider(6, range=0..10),
    ZHopHeight=Slider(2, range=0..10),
    NozzleDiameter=Slider(1.5, range=0..10),
    MeshingResolution=Slider(0.5, range=0..1),
    SmoothingWindow=Slider(3, range=0..100),
    DegenerateAspectRatio=Slider(2.723, range=0..10),
    MaxLayerHeight=Slider(1.61, range=0..10))
merge_4 = Merge(Data1=flatten(fdm_operation_3), Data2=flatten(fdm_operation_2), Data3=flatten(fdm_toolpath_23))

# ----
# max and min zhop are dangerous settings!
# they are absolute and not relative to the toolpath!!
number_slider_13 = Slider(1.344, range=0..5)
# zHop
number_slider_14 = Slider(10, range=0..10)
fdmdefaults_2 = FDMDefaults(InitZHeight=number_slider_14, ZHopHeight=number_slider_13)

# ----
# gcode
panel_3 = Panel(";additional start gcode")
home_before_printing = BooleanToggle(True)
# degenerate extrusion detection
# A degenerate extrusion is an extrusion that has zero height, zero width, or zero area.
# moving average on the extrusion widths
# for smoother preview
number_slider_15 = Slider(1, range=0..1)
fdmdefaults_3 = FDMDefaults(StartGCode=panel_3, EndGCode=";additional end gcode", HomeBeforePrint=home_before_printing, EPosAbsRel=number_slider_15)

# ----
# meshing
# the heightfield is used to calculate all extrusion processes.
# the meshing resolution affects the coarseness of the extrusion mesh along the path
number_slider_16 = Slider(0.3, range=0.1..1.1)
fdmdefaults_4 = FDMDefaults(HeightfieldResolution=number_slider_16, MeshingResolution=Slider(0.3, range=0.1..1.1))

# ----
# nozzle
# filament diameter is used to set the extruder feedrate
# nozzle diameter is used troughout the program, make sure to set it!
number_slider_17 = Slider(1.75, range=0..10)
fdmdefaults_5 = FDMDefaults(FilamentDiameter=number_slider_17, NozzleDiameter=Slider(1.12, range=0..10))

list_2 = ValueList({"default": 0, "zhop": 1, "nozzle": 2, "meshing": 3, "gcode": 4, "degenerate extrusion detection": 5}, selected="default")

# ----
# Degenerate modes handle zero-thickness
#  points by either calculating replacement values
#  from neighboring samples to maintain continuity
# (0) or flagging them as suppressed to omit them
#  from the simulation (1).
number_slider_18 = Slider(0, range=0..1)
# extrusions beyond this ratio are degen
# Extrusions above this are clamped to a"last known good" volume
# to prevent it from filling impossible layerheight in "auto width" mode
# Extrusions below minH are "degen" and trigger rescue or skip logic.
number_slider_19 = Slider(5, range=0..10)
fdmdefaults_6 = FDMDefaults(
    SmoothingLookahead=Slider(0.4, range=0..1),
    DegenerateBehavior=number_slider_18,
    DegenerateAspectRatio=number_slider_19,
    MinLayerHeight=Slider(0.1, range=0..1),
    MaxLayerHeight=Slider(5, range=0..10))

filter = StreamFilter(
    Gate=list_2,
    Stream0=fdmdefaults,
    Stream1=fdmdefaults_2,
    Stream2=fdmdefaults_5,
    Stream3=fdmdefaults_4,
    Stream4=fdmdefaults_3,
    Stream5=fdmdefaults_6)

# ----
# [double gating limit changes to the
# defaults when "fdm defaults"  is selected]
equals = Equality(FirstNumber=list, SecondNumber=3)  # -> Equality, Inequality
filter_2 = StreamFilter(Gate=equals.Equality, Stream0=fdmdefaults, Stream1=filter)

# ----
# increase the segement count to make the extrusion mesh rounder
number_slider_20 = Slider(3, range=0..10)

# ----
# use the color componet to define custom colors
swatch = ColourSwatch(SwatchColor=RGB(90, 158, 242))
colors = Colors(FDMExtrusion=swatch, FDMTravel=ColourSwatch(SwatchColor=RGB(252, 254, 255)))

# ----
# use baking to output actual geometry to grasshopper. (slow)
toggle_2 = BooleanToggle(False)

# ----
# the flow modulator can be used to varie the flow of material along the path
number_slider_21 = Slider(1, range=0..10)
# Modulators control properties of a toolpath along its length, segment by segment.
# Flow Modulator
geo_33 = Geometry(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)
# MODULATORS
fdm_toolpath_28 = FDMToolpath(Curve=geo_33, Volume=number_slider_21)
panel_4 = Panel("""1
3
1
3
1
3
1""")
mod_flow = ModulatorFlow(Input=fdm_toolpath_28, Scales=panel_4, VertexMappingStrategy=2)

# ----
# subdivide modulator adds more segments to the path
# normal displacement moves the control points
#  normal to the path direction in a selected plane (xy)
number_slider_22 = Slider(2, range=0..10)
# Subdivide  + Normal Displacement
geo_34 = Geometry(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)
fdm_toolpath_29 = FDMToolpath(Curve=geo_34, EWidth=number_slider_22)
mod_subdivide = ModulatorSubdivide(
    Input=fdm_toolpath_29,
    SegmentLength=0,
    DivisionsPerSegment=Slider(11, range=3..15),
    RemapMode=2,
    RespectClosed=True,
    SubdividePolylines=False)
panel_5 = Panel("""-1
-1
1
1""")
multiplication = Multiplication(A=panel_5, B=Slider(5, range=0..10))
mod_ndisp = ModulatorNormalDisplacement(Input=mod_subdivide, Distances=multiplication, VertexMappingStrategy=2, Mode=0)

# ----
# Normal Displacement 3D
geo_35 = Geometry(Point(124.3394153, 170.2310199, 0))
cyl_2 = Cylinder(Base=geo_35, Radius=Slider(10, range=0..100), Length=Slider(19, range=0..100))
fdm_vase_4 = FDMVaseModeGenerator(
    Geometry=cyl_2,
    LayerHeight=1,
    Divisions=Slider(46, range=0..100),
    AlternatingPattern=Toggle(False),
    ShiftStart=Slider(0.5, range=0..1))  # -> Curves, StartCurves, EndCurves
panel_6 = Panel("""-1
-1
1
1""")
fdm_toolpath_30 = FDMToolpath(Curve=fdm_vase_4.Curves, EWidth=Slider(2, range=0..10))
multiplication_2 = Multiplication(A=panel_6, B=Slider(1, range=0..10))
mod_ndisp_2 = ModulatorNormalDisplacement(Input=fdm_toolpath_30, Distances=multiplication_2, VertexMappingStrategy=2, Mode=0)

# ----
# Vector Field
geo_36 = Geometry(Point(161.3971625, 169.3052497, 0))
cir = Circle(Plane=geo_36, Radius=Slider(10, range=0..100))
# curve divider subdivides curves
# into even segments with an aprox. length
curvedivide = CurveDivider(Curves=cir, SegmentLength=Slider(2, range=0..10), SubdividePolylines=False)
fdm_toolpath_31 = FDMToolpath(Curve=curvedivide, EWidth=Slider(2, range=0..10))
Z = UnitZ(Factor=1)
# the vector field modulator displaces the toolpaths in a smooth vector field.
# right click to reveal further smoothing optinon
arrlinear = LinearArray(Geometry=fdm_toolpath_31, Direction=Z, Count=Slider(20, range=0..100))  # -> Geometry, Transform
vec = Vector([Vector(1, 0, 0), Vector(0, 1, 0), Vector(0, 0, 0), Vector(-0.6253084452, -0.780377696, 0)])
geo_37 = Geometry([Point(101.292012, 167.1058707, 13.25753348), Point(163.9638994, 158.2793554, 13.25753348), Point(161.3971625, 169.3052497, 0), Point(158.4955606, 162.9774588, 9.426950082)])
mod_intervecfield = ModulatorInterpolatedVectorField(Input=arrlinear.Geometry, Points=geo_37, Vectors=vec, Power=Slider(2.5, range=0..10), Strength=Slider(8, range=0..100))

merge_5 = Merge(Data1=flatten(mod_ndisp), Data2=flatten(mod_intervecfield), Data3=mod_ndisp_2)

# ----
# combining masks
geo_38 = Geometry(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)
geo_39 = Geometry(Point(145.441354, 210.1205834, 8.658771264))
fdm_toolpath_32 = FDMToolpath(Curve=geo_38, EWidth=Slider(2, range=0..10))
sph = Sphere(Base=geo_39, Radius=Slider(7, range=0..100))
sph_2 = Sphere(Base=geo_39, Radius=Slider(11, range=0..100))
maskregion = MaskFromRegion(
    Input=fdm_toolpath_32,
    RegionGeometry=sph,
    Invert=False,
    Falloff=0,
    CombinationModeEnabled=False,
    FalloffModeEnabled=False)
maskregion_2 = MaskFromRegion(
    Input=fdm_toolpath_32,
    RegionGeometry=sph_2,
    Invert=False,
    Falloff=0,
    CombinationModeEnabled=False,
    FalloffModeEnabled=False)
subtraction = Subtraction(A=maskregion_2, B=maskregion)
min = Minimum(A=maskregion_2, B=maskregion)
num = Number([0, 0, -2.11848, -2.11848])
mod_ndisp_3 = ModulatorNormalDisplacement(Input=fdm_toolpath_32, Distances=num, VertexMappingStrategy=2, Mode=0, Mask=subtraction)

geo_40 = Geometry(Point(5.978748627, 60.06827145, 0))
geo_41 = Geometry(Point(6.532478922, -6.824191448, 0))
geo_42 = Geometry(Point(7.271638402, 148.3045184, 0))
geo_43 = Geometry(Point(6.492423011, 105.275779, 0))
geo_44 = Geometry(Point(12.80145116, 197.1907515, 0))
merge_6 = Merge(Data1=geo_40, Data2=geo_41, Data3=geo_43, Data4=geo_42, Data5=geo_44)
merge_7 = Merge(Data1="TOOLPATHS", Data2="CURVE GENERATION", Data3="SETTINGS HIERARCHY", Data4="MODULATORS", Data5="MASKS")
xy_5 = XYPlane(Origin=merge_6)
tag = TextTag3D(
    Location=xy_5,
    Text=merge_7,
    Size=Slider(4, range=0..10),
    Colour=ColourSwatch(SwatchColor=RGB(26, 26, 26)),
    Justification=7)
num_2 = Number([0, 0, -2.11848, -2.11848])

# ----
# mode: sphere create a shericial gradient around the point
# the graph mapper can be used to sharpen the gradient
number_slider_23 = Slider(2, range=0..10)
# masks are numbers
geo_45 = Geometry(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)
# mask are values. you can use math operations to modify them
fdm_toolpath_33 = FDMToolpath(Curve=geo_45, EWidth=number_slider_23)
geo_46 = Geometry(Point(95.09686967, 208.6346587, 10.30170012))
maskgradient = MaskGradient(Input=fdm_toolpath_33, Mode=1, Base=geo_46, Wavelength=Slider(5.01, range=0..100), Wrap=1)
graph = GraphMapper(maskgradient, x0=0, x1=1, y0=0, y1=1, container_name="Bezier", cpx=[0, 1, 0.05815500394, 1], cpy=[0, 0, 1, 1])
mod_ndisp_4 = ModulatorNormalDisplacement(Input=fdm_toolpath_33, Distances=num_2, VertexMappingStrategy=2, Mode=0, Mask=graph)

# ----
# infill generation
number_slider_24 = Slider(148, range=0..360)
X = UnitX(Factor=1)
rotate = Rotate(Geometry=X, Angle=degrees(number_slider_24), Plane=PlaneXY(0, 0, 0))  # -> Geometry, Transform
list_3 = ValueList({"Monotonic": 0, "Monotonic (Connected)": 1}, selected="Monotonic (Connected)")
geo_47 = Geometry(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)
_2_3 = Integer(2)
_2_4 = Integer(2)

fdm_infill = FDMInfillGenerator(InfillCurves=geo_47, Direction=rotate.Geometry, LineWidth=_2_3, MinLength=0, InfillType=list_3)

fdm_toolpath_34 = FDMToolpath(Curve=fdm_infill, EWidth=_2_4)

# ----
# basic planar slicing
# create planar slice curves
# create wall curves
# create infill curves
# create toolpath object
input_geo = Geometry(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)
planar_slice = FDMPlanarSliceGenerator(Geometry=input_geo, LayerHeight=1, MaxSegmentLength=0.3)
list_4 = ValueList({"Monotonic": 0, "Monotonic (Connected)": 1}, selected="Monotonic (Connected)")
fdm_walls_3 = FDMWallsGenerator(
    Curves=planar_slice,
    LineWidth=Slider(2, range=0..10),
    Count=Slider(2, range=0..10),
    InfillOffset=Slider(0.22, range=0..1))  # -> Curves, InfillCurves

fdm_infill_2 = FDMInfillGenerator(InfillCurves=fdm_walls_3.InfillCurves, LineWidth=2, MinLength=0, InfillType=list_4)

merge_8 = Merge(Data1=fdm_walls_3.Curves, Data2=fdm_infill_2)
fdm_toolpath_35 = FDMToolpath(Curve=merge_8, EWidth=Slider(2, range=0..10))

# ----
# generate vase mode  path
# shift start generates planar slices for the first layers
# planar slice for the first layers
number_slider_25 = Slider(2.326, range=0..10)
fdm_vase_5 = FDMVaseModeGenerator(Geometry=cyl, LayerHeight=1, Divisions=18, AlternatingPattern=False, ShiftStart=number_slider_25)  # -> Curves, StartCurves, EndCurves
list_5 = ValueList({"Monotonic": 0, "Monotonic (Connected)": 1}, selected="Monotonic")

fdm_walls_4 = FDMWallsGenerator(
    Curves=fdm_vase_5.StartCurves,
    LineWidth=Slider(2, range=0..10),
    Count=1,
    InfillOffset=0,
    ManualOffsets=Slider(0, range=0..100))  # -> Curves, InfillCurves

fdm_infill_3 = FDMInfillGenerator(InfillCurves=fdm_walls_4.InfillCurves, LineWidth=2, MinLength=0, InfillType=list_5)

merge_9 = Merge(Data1=fdm_vase_5.Curves, Data2=fdm_walls_4.Curves, Data3=fdm_infill_3)
fdm_toolpath_36 = FDMToolpath(Curve=merge_9, EWidth=Slider(2, range=0..10))

# ----
# [wip] data output is not complete
fdmtp = FDMToolpath(maelstrom)
yz = YZPlane(Origin=Point(54.67798807, 70.98935959, 0))
# toolpaths can be deconstructed into pure geometry and data
mirror = Mirror(Geometry=fdmtp, Plane=yz)  # -> Geometry, Transform

decon_fdm = DeconstructFDMToolpath(Toolpath=mirror.Geometry)  # -> Path, Vertices

geo_48 = Geometry(decon_fdm.Vertices)
crv = Curve(decon_fdm.Path)

fdmcmd = FDMCommand(PauseSeconds=Slider(3, range=0..10))
fdmcmd_2 = FDMCommand(CustomGCode=" M800 ;custom gcode")
geo_49 = Geometry(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)

groupcmd = GroupCommands(Commands=[fdmcmd_2, fdmcmd])

fdm_toolpath_37 = FDMToolpath(Curve=geo_49, CommandsPre=groupcmd, CommandsPost=fdmcmd_2)

merge_10 = Merge(
    Data1=fdm_toolpath_9,
    Data2=fdm_toolpath_16,
    Data3=fdm_toolpath_11,
    Data4=fdm_toolpath_13,
    Data5=fdm_toolpath_14,
    Data6=fdm_toolpath_37,
    Data7=fdm_toolpath_17)

toolpath_options = Merge(Data1=flatten(merge_3), Data2=flatten(merge_2), Data3=flatten(fdm_operation), Data4=flatten(merge_10))
# SETTINGS HIERARCHY
merge_11 = Merge(Data1=flatten(merge_4))
curve_gen = Merge(
    Data1=flatten(fdm_toolpath_3),
    Data2=flatten(fdm_toolpath_5),
    Data3=flatten(fdm_toolpath_34),
    Data4=flatten(fdm_toolpath_35),
    Data5=flatten(fdm_toolpath_36),
    Data6=flatten(fdm_toolpath),
    Data7=flatten(fdm_toolpath_2),
    Data8=flatten(fdm_toolpath_4))

# ----
# SIMULATE + GCODE
# FDM simulator creates a scrubbable preview from all processed toolpaths
# playback controls
number_slider_26 = Slider(1, range=0..1)

# ----
# Gcode output
# select machine type
# select a DIRECTORY to save the file
# by default it saves to the desktop
# upload works for klipper and reprap
# start printing after upload?
# path to a 3mf file used as a template bambu files
machine = Machine({"Klipper": "klipper", "RepRap": "reprap", "Prusa": "prusa", "Bambu": "bambu"}, selected="Klipper")
path = FilePath()
path_2 = FilePath()

# ----
# the path has 7 segments
# the modulator maps the supplied flow values
# (1 and 3)  to the segments of the toolpath
# array mutiplies the toolpath 5 times
# as there are 7 segments and only 2 values
# the modulator has to map the values
# somehow to the segments.
# the options are:
# 0 constant -> 1 1 1 1 1 1 1
# 2 wrap -> 131313131
# 3 repeat last -> 1333333
# 4 normalized -> 1111333
# 5 interpolated -> 1 1.3 1.7 2 2.3 2.7 3
number_slider_27 = Slider(1, range=0..10)
geo_50 = Geometry(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)
# Vertex Mapping
explode = Explode(Curve=geo_50, Recursive=True)  # -> Segments, Vertices
lng = ListLength(List=explode.Segments)
fdm_toolpath_38 = FDMToolpath(Curve=geo_50, Volume=number_slider_27)
panel_7 = Panel(lng)
panel_8 = Panel("""0
2
3
4
5""")
panel_9 = Panel("""1
3""")

Y = UnitY(Factor=4.808)
arrlinear_2 = LinearArray(Geometry=fdm_toolpath_38, Direction=Y, Count=5)  # -> reverse(Geometry), Transform

mod_flow_2 = ModulatorFlow(Input=arrlinear_2.Geometry, Scales=panel_9, VertexMappingStrategy=panel_8)

merge_12 = Merge(Data1=flatten(mod_flow), Data2=flatten(mod_flow_2))

merge_13 = Merge(Data1=flatten(merge_12), Data2=flatten(merge_5))

# ----
# Mask from region
geo_51 = Geometry(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)
# an optional falloff creates a smooth transition
geo_52 = Geometry(Point(23.73628212, 210.6243736, 3.620420091))
# MASKS
fdm_toolpath_39 = FDMToolpath(Curve=geo_51, EWidth=Slider(2, range=0..10))
# the region mask constrict the displacment with the sphere
toggle_3 = BooleanToggle(False)
num_3 = Number([-0.679, -0.679, 0.679, 0.679])

# ----
# inverting the mask flips the effect
cone = Cone(Base=geo_52, Radius=9, Length=16)  # -> Cone, Tip
# Masks are multipliers for Modulators.
# In the range 0..1 they act as a filter and lessen the effect of the modulator.
# For values larger 1 they can be used to increase the effect of a modulator.
cap = CapHoles(Brep=cone.Cone)

maskregion_3 = MaskFromRegion(
    Input=fdm_toolpath_39,
    RegionGeometry=cap,
    Invert=toggle_3,
    Falloff=Slider(0, range=0..4),
    CombinationModeEnabled=False,
    FalloffModeEnabled=False)
mod_ndisp_5 = ModulatorNormalDisplacement(Input=fdm_toolpath_39, Distances=num_3, VertexMappingStrategy=2, Mode=0, Mask=maskregion_3)

# ----
# gradient mask creates a ramp from 0..1
# based on a input geomerty and a period length
number_slider_28 = Slider(2, range=0..10)
# Gradient mask
geo_53 = Geometry(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)
fdm_toolpath_40 = FDMToolpath(Curve=geo_53, EWidth=number_slider_28)
geo_54 = Geometry(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)
len = Length(Curve=geo_54)
num_4 = Number([-0.679, -0.679, 0.679, 0.679])

maskgradient_2 = MaskGradient(Input=fdm_toolpath_40, Mode=0, Base=geo_54, Wavelength=len)

mod_ndisp_6 = ModulatorNormalDisplacement(Input=fdm_toolpath_40, Distances=num_4, VertexMappingStrategy=2, Mode=0, Mask=maskgradient_2)

merge_14 = Merge(Data1=mod_ndisp_5, Data2=mod_ndisp_6, Data3=mod_ndisp_4, Data4=mod_ndisp_3)

merge_15 = Merge(Data1=flatten(merge_14))
filter_3 = StreamFilter(
    Gate=list,
    Stream0=curve_gen,
    Stream1=toolpath_options,
    Stream2=merge_11,
    Stream3=curve_gen,
    Stream4=merge_13,
    Stream5=merge_15)

# ----
# FDM DEFAULTS
# "fdm machine"  takes all toolpaths and operations
# in input "T/O" and processes them.
fdm_machine = FDMMachine(ToolpathsOperations=filter_3, Defaults=filter_2, HFTime=-1, DebugOutputs=False)  # -> SimulationData, Errors, Warnings, HFPoints, SamplePoints, SampleHeights, TripleProbeTree

fdm_sim = FDMSimulator(
    SimulationData=fdm_machine.SimulationData,
    Time=number_slider_26,
    Play=Toggle(False),
    Speed=Slider(1, range=0.3..3),
    StadiumSegments=number_slider_20,
    BakeMeshes=toggle_2,
    Colors=colors)  # -> CurrentTime, Meshes, ToolPosition

fdm_g_code = FDMGCodeOutput(
    SimulationData=fdm_machine.SimulationData,
    MachineType=machine,
    Save=Button(),
    Upload=Button(),
    PrinterIPAddress="192.168.0.101",
    StartPrint=Toggle(False),
    Template3MF=path_2)  # -> GCode, Toolpath, Info, VerboseDebug, ToolpathDebug

mesh = Mesh(fdm_sim.Meshes)
