# Grasshopper definition toolpath_showcase_beta-24.gh (Grasshopper 1.0.8)
# plug-ins: Toolpaths.Fdm, Toolpaths.Gh

list = ValueList({"Offset": 0, "Spiral": 1}, selected="Offset")
list_2 = ValueList({"Offset": 0, "Spiral": 1}, selected="Offset")
list_3 = ValueList({"Monotonic": 0, "Monotonic (Connected)": 1, "Gyroid": 2, "Gyroid (Connected)": 3, "Spiral": 4}, selected="Monotonic (Connected)")

# ----
# infill generation
X = UnitX(Factor=1)
rotate = Rotate(Geometry=X, Angle=degrees(Slider(148, range=0..360)), Plane=PlaneXY(0, 0, 0))  # -> Geometry, Transform
geo = Geometry(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)
_2 = Integer(2)
fdm_infill = FDMInfillGenerator(InfillCurves=geo, Direction=rotate.Geometry, InfillSpacing=_2, MinLength=0, InfillType=list_3)
_2_2 = Integer(2)
fdm_toolpath = FDMToolpath(Curve=fdm_infill, EWidth=_2_2)

list_4 = ValueList({"Monotonic": 0, "Monotonic (Connected)": 1, "Gyroid": 2, "Gyroid (Connected)": 3, "Spiral": 4}, selected="Monotonic")
number = Number(0.3)
list_5 = ValueList({"Offset": 0, "Spiral": 1}, selected="Offset")
number_2 = Number(0.3)
_2_3 = Integer(2)
vase_options = FDMVaseOptions(BaseThickness=number)
vase_options_2 = FDMVaseOptions(BaseThickness=number_2)
list_6 = ValueList({"Monotonic": 0, "Monotonic (Connected)": 1, "Gyroid": 2, "Gyroid (Connected)": 3, "Spiral": 4}, selected="Monotonic (Connected)")
list_7 = ValueList({"Offset": 0, "Spiral": 1}, selected="Offset")

# ----
# Extrusion Modes
number_slider = Slider(2, range=0..10)
# set the extruder number to assign different extruders
number_slider_2 = Slider(1, range=0..1)
# Multi-extruder
geo_2 = Geometry(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)
fdm_toolpath_2 = FDMToolpath(Curve=geo_2, Extruder=number_slider_2, EWidth=number_slider)

# ----
# "static" defines the size explicitly with width, height
e_mode = EMode({"E Area": 0, "Auto Width": 1, "Auto Ratio": 2, "Static": 3, "No Extrusion": 4}, selected="Static")
geo_3 = Geometry(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)
fdm_toolpath_3 = FDMToolpath(Curve=geo_3, EMode=e_mode, EWidth=Slider(2, range=0..10), EHeight=Slider(1, range=0..10))

# ----
# "volume" defines the amount of material extruded per millimeter of travel. (mm^3/mm)
# Another way to say it is that this is the cross-section area of the extrusion
e_mode_2 = EMode({"Volume": 0, "Auto Width": 1, "Auto Ratio": 2, "Static": 3, "No Extrusion": 4}, selected="Volume")
geo_4 = Geometry(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)
fdm_toolpath_4 = FDMToolpath(Curve=geo_4, EMode=e_mode_2, Volume=Slider(2.3, range=0..5))

# ----
# "auto width" adjust the amount of material extruded to achive a target width.
# it does so my checking agains all other extrusions in the program
e_mode_3 = EMode({"E Area": 0, "Auto Width": 1, "Auto Ratio": 2, "Static": 3, "No Extrusion": 4}, selected="Auto Width")
# "auto ratio" works the same way as auto
#  with but adjust the material to get to a specified width/heigth ratio
number_slider_3 = Slider(2.1, range=0..4)
geo_5 = Geometry(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)
fdm_toolpath_5 = FDMToolpath(Curve=geo_5, EMode=e_mode_3, EWidth=number_slider_3)

e_mode_4 = EMode({"E Area": 0, "Auto Width": 1, "Auto Ratio": 2, "Static": 3, "No Extrusion": 4}, selected="Auto Ratio")
geo_6 = Geometry(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)
fdm_toolpath_6 = FDMToolpath(Curve=geo_6, EMode=e_mode_4, ERatio=Slider(3.04, range=0..10))

# ----
# toolpath options
# extend at start / end will dynamically extend the toolpath by the given distance.
# closed curves will loop around -- open curves will extend along the tangent
geo_7 = Geometry([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])
fdm_toolpath_7 = FDMToolpath(Curve=geo_7, ExtendAtStart=Slider(1.936, range=0..10), ExtendAtEnd=Slider(2.716, range=0..10))

# ----
# retract specifies the amount of material retracted into the nozzle at the end of the toolpath. this prevents oozing.
geo_8 = Geometry(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)
fdm_toolpath_8 = FDMToolpath(Curve=geo_8, Retraction=Slider(1.3, range=0..10))

# ----
# "no extrusion" will not extrude any material
e_mode_5 = EMode({"E Area": 0, "Auto Width": 1, "Auto Ratio": 2, "Static": 3, "No Extrusion": 4}, selected="No Extrusion")
geo_9 = Geometry(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)
fdm_toolpath_9 = FDMToolpath(Curve=geo_9, EMode=e_mode_5)

# ----
# "speed" specifies the velocity of the toolpath in mm/s
geo_10 = Geometry(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)
fdm_toolpath_10 = FDMToolpath(Curve=geo_10, Speed=Slider(60, range=0..100))

# ----
# zhop specifies a movement in Z at the end of the toolpath. it prevents collisions with the printed material
geo_11 = Geometry(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)
fdm_toolpath_11 = FDMToolpath(Curve=geo_11, ZHop=Slider(7.29, range=0..10))

# ----
# "commands" can be executed before or after the toolpath move. use CmdPre / Post respectively
number_slider_4 = Slider(18, range=0..100)
# "z axis speed" is the speed used for movents in the z axis
geo_12 = Geometry(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)
fdm_toolpath_12 = FDMToolpath(Curve=geo_12, ZAxisSpeed=number_slider_4)

# ----
# Hint: while static mode is the most intuitive, in 3d printing the
# height of the extrusion is not a property that can be influenced directly.
# The height is rather the distance to the last layer.
# TOOLPATHS simulates the extrusion process so that height is
# derived form a heightfield containing all extrusions.
number_slider_5 = Slider(3.2, range=0..10)
# Hint: when possible the correct mode is selected automatically
geo_13 = Geometry(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)
fdm_toolpath_13 = FDMToolpath(Curve=geo_13, EWidth=number_slider_5)

# ----
# "temperature" sets the nozzle or bed temperature
geo_14 = Geometry(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)
fdm_toolpath_14 = FDMToolpath(Curve=geo_14, ExtruderTemperature=Slider(200, range=0..1000), BedTemperature=Slider(60, range=0..100))

geo_15 = Geometry(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)
extrvolume = FDMExtrusionVolume(Width=Slider(1.508, range=0..10), Height=Slider(1, range=0..10))
fdm_toolpath_15 = FDMToolpath(Curve=geo_15, Volume=extrvolume)

# ----
# "flow" acts as a multiplier on top of the other modes
# it can also be used to increase the material in auto width mode
geo_16 = Geometry(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)
fdm_toolpath_16 = FDMToolpath(Curve=geo_16, EWidth=Slider(1, range=0..10), Flow=Slider(2.9, range=0..10))

# ----
# toolpath object are still grasshopper geometry
# and can be copied with standart geometry operations
geo_17 = Geometry(Point(16.74433711, 73.13769757, 0))

# ----
# toolpath object
geo_18 = Geometry(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)
_2_4 = Integer(2)
# TOOLPATHS
fdm_toolpath_17 = FDMToolpath(Curve=geo_18, EWidth=_2_4)
# works even with complex transforms
number_slider_6 = Slider(5, range=0..10)
xy = XYPlane(Origin=geo_17)
arrpolar = PolarArray(Geometry=fdm_toolpath_17, Plane=xy, Count=number_slider_6, Angle=6.283185307)  # -> Geometry, Transform

geo_19 = Geometry(Point(44.01161679, 71.96222899, 0))

# ----
# maelstrom does the thing
# toolpaths is defined as a line
number_slider_7 = Slider(1.1, range=0..10)
geo_20 = Geometry(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)
fdm_toolpath_18 = FDMToolpath(Curve=geo_20, EWidth=number_slider_7)
xy_2 = XYPlane(Origin=geo_19)
pi = Pi(Factor=Slider(4.49, range=0..6))
maelstrom = Maelstrom(Geometry=fdm_toolpath_18, Plane=xy_2, First=0.1, Second=10, Angle=pi, Rigid=False)

fdmtp = FDMToolpath(maelstrom)
yz = YZPlane(Origin=Point(52.80372864, 70.98935959, 0))
# toolpaths can be deconstructed into pure geometry and data
mirror = Mirror(Geometry=fdmtp, Plane=yz)  # -> Geometry, Transform
decon_fdm = DeconstructFDMToolpath(Toolpath=mirror.Geometry)  # -> Path, Speed, Flow, EMode, Volume, Vertices
crv = Curve(decon_fdm.Path)
geo_21 = Geometry(decon_fdm.Vertices)

# ----
# select column to preview
list_8 = ValueList({"CURVE GENERATION": 0, "TOOLPATH OPTIONS": 1, "SETTINGS HIERARCHY": 2, "FDM DEFAULTS": 3, "MODULATORS": 4, "MASKS": 5}, selected="CURVE GENERATION")

merge = Merge(
    Data1=fdm_toolpath_2,
    Data2=fdm_toolpath_3,
    Data3=fdm_toolpath_4,
    Data4=fdm_toolpath_5,
    Data5=fdm_toolpath_6,
    Data6=fdm_toolpath_9,
    Data7=fdm_toolpath_13,
    Data8=fdm_toolpath_15,
    Data9=fdm_toolpath_16)
merge_2 = Merge(Data1=flatten(arrpolar.Geometry), Data2=flatten(maelstrom))

geo_22 = Geometry(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)
fdm_toolpath_19 = FDMToolpath(Curve=geo_22, ZHop=Slider(1.2, range=0..5))

geo_23 = Geometry(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)
fdm_toolpath_20 = FDMToolpath(Curve=geo_23, ZHop=Slider(4.1, range=0..5))

geo_24 = Geometry(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)
fdm_toolpath_21 = FDMToolpath(Curve=geo_24, ZHop=Slider(0.6, range=0..5))

geo_25 = Geometry(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)
fdm_toolpath_22 = FDMToolpath(Curve=geo_25, ZHop=Slider(4.9, range=0..5))

# ----
# in this example the zHop will be 2mm as it falls back to the value specified in the default component
geo_26 = Geometry(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)
fdm_toolpath_23 = FDMToolpath(Curve=geo_26)  # -> flatten(Toolpath)

# ----
# Settings follow a simple hierachy
# Global Defaults (lowest) → Linked Template → Local Override (highest).
#  You can use any existing toolpath as a template for a new one,
# inheriting all properties automatically and overriding only what is necessary.
# properties at the default level are used as a fallback.
# if no other setting is applied the default value is used.
number_slider_8 = Slider(0.5, range=0..1)
defaults = FDMDefaults(
    HeightfieldResolution=number_slider_8,
    SafeClearance=Slider(6, range=0..10),
    ZHopHeight=Slider(2, range=0..10),
    MeshingResolution=Slider(0.5, range=0..1),
    SmoothingWindow=Slider(1, range=0..100),
    DegenerateAspectRatio=Slider(6.123, range=0..10),
    MaxLayerHeight=Slider(3.072, range=0..10))

# ----
# in this example the zhop will be 3.2mm as last applied setting overwrites all other settings
# Toolpaths can inherit all settings from a template toolpath via the Toolpath input.
# properties can be set on a per toolpath level
# Local settings on the toolpath override both inherited
# properties and global defaults.
# properties set at toolpath level overwrite
# defaults
relay = Relay([fdm_toolpath_19, fdm_toolpath_20])
fdm_toolpath_24 = FDMToolpath(Toolpath=relay, ZHop=Slider(3.2, range=0..5))

# ----
# in this example the zhop will be 0.6mm for the first toolpath and 4.9mm for the second
# as the child toolpath does not specify
#  a new zhop value all  input toolpath preserve their value
relay_2 = Relay([fdm_toolpath_21, fdm_toolpath_22])

# ----
# in this case the zhop stays the same but
# speed is set to 2 for both toolpaths
number_slider_9 = Slider(2, range=0..10)
fdm_toolpath_25 = FDMToolpath(Toolpath=relay_2, Speed=number_slider_9)
merge_3 = Merge(Data1=flatten(fdm_toolpath_24), Data2=flatten(fdm_toolpath_25), Data3=flatten(fdm_toolpath_23))

# ----
# max and min zhop are dangerous settings!
# they are absolute and not relative to the toolpath!!
number_slider_10 = Slider(1.344, range=0..5)
# zHop
number_slider_11 = Slider(10, range=0..10)

# ----
# meshing
# the meshing resolution affects the coarseness of the extrusion mesh along the path
# moving average window for preview
# the heightfield is used to calculate all extrusion processes.
number_slider_12 = Slider(0.3, range=0.1..1.1)
fdmdefaults = FDMDefaults(
    MeshingResolution=number_slider_12,
    SmoothingWindow=Slider(3, range=0..10),
    HeightfieldResolution=Slider(0.3, range=0.1..1.1))

# ----
# gcode
panel = Panel(";additional start gcode")
# degenerate extrusion detection
# A degenerate extrusion is an extrusion that has zero height, zero width, or zero area.
# Degenerate modes handle zero-thickness
#  points by either calculating replacement values
#  from neighboring samples to maintain continuity
# (0) or flagging them as suppressed to omit them
#  from the simulation (1).
extrudermode_abs_rel = Slider(1, range=0..1)
home_before_printing = BooleanToggle(True)
fdmdefaults_2 = FDMDefaults(
    StartGCode=panel,
    EndGCode=";additional end gcode",
    HomeBeforePrint=home_before_printing,
    EPosAbsRel=extrudermode_abs_rel)

# ----
# nozzle
# filament diameter is used to set the extruder feedrate
# nozzle diameter is used troughout the program, make sure to set it!
number_slider_13 = Slider(1.75, range=0..10)
fdmdefaults_3 = FDMDefaults(FilamentDiameter=number_slider_13, NozzleDiameter=Slider(1.12, range=0..10))

_0 = Integer(0)

list_9 = ValueList({"default": 0, "zhop": 1, "nozzle": 2, "meshing": 3, "gcode": 4, "degenerate extrusion detection": 5}, selected="default")

# ----
# extrusions beyond this ratio are degen
# Extrusions below minH are "degen" and trigger rescue or skip logic.
# Extrusions above this are clamped to a"last known good" volume
# to prevent it from filling impossible layerheight in "auto width" mode
number_slider_14 = Slider(6.02, range=0..10)
fdmdefaults_4 = FDMDefaults(
    DegenerateBehavior=Slider(0, range=0..1),
    DegenerateAspectRatio=number_slider_14,
    MinLayerHeight=Slider(0.1, range=0..1),
    MaxLayerHeight=Slider(5, range=0..10))

fdmdefaults_5 = FDMDefaults(SafeClearance=number_slider_11, ZHopHeight=number_slider_10)
# see robot example for more details
filter = StreamFilter(
    Gate=list_9,
    Stream0=defaults,
    Stream1=fdmdefaults_5,
    Stream2=fdmdefaults_3,
    Stream3=fdmdefaults,
    Stream4=fdmdefaults_2,
    Stream5=fdmdefaults_4)

# ----
# [double gating limit changes to the
# defaults when "fdm defaults"  is selected]
equals = Equality(FirstNumber=list_8, SecondNumber=3)  # -> Equality, Inequality
# FDM DEFAULTS
filter_2 = StreamFilter(Gate=equals.Equality, Stream0=defaults, Stream1=filter)

# ----
# increase the segement count to make the extrusion mesh rounder
number_slider_15 = Slider(3, range=0..10)

# ----
# use the color componet to define custom colors
# Gcode output
swatch = ColourSwatch(SwatchColor=RGB(252, 254, 255))
colors = Colors(FDMTravel=swatch)

# ----
# use baking to output actual geometry to grasshopper. (slow)
toggle = BooleanToggle(False)

# ----
# FDM simulator creates a scrubbable preview from all processed toolpaths
toggle_2 = BooleanToggle(False)
# SIMULATE + GCODE
# playback controls
number_slider_16 = Slider(1, range=0..1)

machine = Machine({"Klipper": "klipper", "Klipper (No Z)": "klipper_noz", "RepRap": "reprap", "Prusa": "prusa", "Bambu": "bambu"}, selected="Klipper")

# ----
# the flow modulator can be used to varie the flow of material along the path
number_slider_17 = Slider(1, range=0..10)
# Modulators control properties of a toolpath along its length, segment by segment.
# Flow Modulator
geo_27 = Geometry(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)
# MODULATORS
fdm_toolpath_26 = FDMToolpath(Curve=geo_27, Volume=number_slider_17)
panel_2 = Panel("""1
3
1
3
1
3
1""")

mode = Mode({"Angle": 0, "Length": 1}, selected="Angle")
_2_5 = Integer(2)

# ----
# Subdivide  + Normal Displacement
# subdivide modulator adds more segments to the path
geo_28 = Geometry(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)
fdm_toolpath_27 = FDMToolpath(Curve=geo_28, EWidth=_2_5)
mod_subdivide = ModulatorSubdivide(
    Input=fdm_toolpath_27,
    SegmentLength=0,
    DivisionsPerSegment=Slider(11, range=3..15),
    RemapMode=2,
    RespectClosed=True,
    SubdividePolylines=False)
panel_3 = Panel("""-1
-1
1
1""")
# normal displacement moves the control points
#  normal to the path direction in a selected plane (xy)
multiplication = Multiplication(A=panel_3, B=Slider(5, range=0..10))
mod_ndisp = ModulatorNormalDisplacement(Input=mod_subdivide, Distances=multiplication, VertexMappingStrategy=2, Mode=0)

mod_flow = ModulatorFlow(Input=fdm_toolpath_26, Scales=panel_2, VertexMappingStrategy=2)
_2_6 = Integer(2)
_20 = Integer(20)

# ----
# Vector Field
geo_29 = Geometry(Point(161.3971625, 169.3052497, 0))
cir = Circle(Plane=geo_29, Radius=10)
curvedivide = CurveDivider(Curves=cir, SegmentLength=2, SubdividePolylines=False)
fdm_toolpath_28 = FDMToolpath(Curve=curvedivide, EWidth=_2_6)
Z = UnitZ(Factor=1)
arrlinear = LinearArray(Geometry=fdm_toolpath_28, Direction=Z, Count=_20)  # -> Geometry, Transform
vec = Vector([Vector(1, 0, 0), Vector(0, 1, 0), Vector(0, 0, 0), Vector(-0.6253084452, -0.780377696, 0)])
# the vector field modulator displaces
# the toolpaths in a smooth vector field.
geo_30 = Geometry([Point(101.292012, 167.1058707, 13.25753348), Point(163.9638994, 158.2793554, 13.25753348), Point(161.3971625, 169.3052497, 0), Point(158.4955606, 162.9774588, 9.426950082)])
mod_intervecfield = ModulatorInterpolatedVectorField(Input=arrlinear.Geometry, Points=geo_30, Vectors=vec, Sigma=Slider(9.5, range=0..10), Strength=Slider(8, range=0..100))

_2_7 = Integer(2)
geo_31 = Geometry(Point(5.978748627, 60.06827145, 0))
geo_32 = Geometry(Point(6.532478922, -6.824191448, 0))
_2_8 = Integer(2)
geo_33 = Geometry(Point(7.271638402, 148.3045184, 0))
geo_34 = Geometry(Point(6.492423011, 105.275779, 0))
_2_9 = Integer(2)
geo_35 = Geometry(Point(12.80145116, 197.1907515, 0))
_2_10 = Integer(2)
merge_4 = Merge(Data1=geo_31, Data2=geo_32, Data3=geo_34, Data4=geo_33, Data5=geo_35)
merge_5 = Merge(Data1="TOOLPATHS", Data2="CURVE GENERATION", Data3="SETTINGS HIERARCHY", Data4="MODULATORS", Data5="MASKS")
xy_3 = XYPlane(Origin=merge_4)
tag = TextTag3D(
    Location=xy_3,
    Text=merge_5,
    Size=Slider(4, range=0..10),
    Colour=ColourSwatch(SwatchColor=RGB(26, 26, 26)),
    Justification=7)
num = Number([0, 0, -2.11848, -2.11848])
mode_2 = ProcessorMode({"Hybrid": 2, "Preview": 1, "Simulation": 0}, selected="Hybrid")

# ----
# planar slice for the first layers
# base thickness generates planar slices for the first layers
number_slider_18 = Slider(2.237, range=0..10)
# vase mode
geo_36 = Geometry(Point(207.8120414, 24.6220849, 0))
_2_11 = Integer(2)

xy_4 = XYPlane(Origin=geo_36)
cyl = Cylinder(Base=xy_4, Radius=Slider(10, range=0..100), Length=Slider(23, range=0..100))

vase_options_3 = FDMVaseOptions(BaseThickness=number_slider_18)
fdm_vase = FDMVaseModeGenerator(Geometry=cyl, LayerHeight=1, ExtrusionWidth=_2_11, Options=vase_options_3)  # -> Toolpath, HelixCurve, UnsampledCurve, TopCurves, BottomCurves
fdm_walls = FDMWallsGenerator(Curves=fdm_vase.BottomCurves, LineWidth=_2_3, Count=1, WallType=list_5, ManualOffsets=Slider(0, range=0..0.01))  # -> Curves, InfillCurves
fdm_infill_2 = FDMInfillGenerator(InfillCurves=fdm_walls.InfillCurves, InfillSpacing=2, MinLength=0, InfillType=list_6)

merge_6 = Merge(Data1=fdm_walls.Curves, Data2=fdm_infill_2)
fdm_toolpath_29 = FDMToolpath(Curve=merge_6, EWidth=Slider(2, range=0..10))

merge_7 = Merge(Data1=fdm_vase.Toolpath, Data2=fdm_toolpath_29)

xy_5 = XYPlane(Origin=Point(244.3094513, 21.29128915, 0))
# variable layer heigh based on slope
geo_37 = Geometry(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)
line = LineSDL(Start=xy_5, Direction=Vector(0, 0, 1), Length=1)
_1 = Mode(1)
revsrf = Revolution(Curve=geo_37, Axis=line, Domain=Domain(0, 6.283185307))

lh_field = FDMLayerHeightField(
    Mode=_1,
    ProfileCurve=geo_37,
    MinimumHeight=Slider(0.2, range=0..1),
    RangeMax=Slider(0.7, range=0..10),
    TargetHeight=0.4,
    BeadWidth=0.8,
    MinimumOverlap=0.25,
    NormalizeRange=Toggle(False))
fdm_vase_2 = FDMVaseModeGenerator(Geometry=revsrf, LayerHeight=1, LayerHeightField=lh_field, ExtrusionWidth=1.5, Options=vase_options_2)  # -> Toolpath, HelixCurve, UnsampledCurve, TopCurves, BottomCurves

fdm_toolpath_30 = FDMToolpath(Curve=fdm_vase_2.HelixCurve, EWidth=Slider(2, range=0..10))

# ----
# variable layer height and shifted postions
# by defining the positions (0..1) of the
# supplied layerheights it is possible to shift
# areas up and down
number_slider_19 = Slider(0.6912, range=0.2..0.9)
_1_2 = Number(1)
_0_2 = Number(0)
merge_8 = Merge(Data1=_0_2, Data2=number_slider_19, Data3=_1_2)
_0_3 = Mode(0)
panel_4 = Panel("""1.7
0.5
1.7""")
geo_38 = Geometry(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)
number_3 = Number(0.3)

lh_field_2 = FDMLayerHeightField(
    Mode=_0_3,
    Heights=panel_4,
    Positions=merge_8,
    MinimumHeight=0.1,
    RangeMax=0.4,
    TargetHeight=0.4,
    BeadWidth=0.8,
    MinimumOverlap=0.25,
    NormalizeRange=False)
vase_options_4 = FDMVaseOptions(BaseThickness=number_3)
fdm_vase_3 = FDMVaseModeGenerator(Geometry=geo_38, LayerHeight=1, LayerHeightField=lh_field_2, ExtrusionWidth=1.5, Options=vase_options_4)  # -> Toolpath, HelixCurve, UnsampledCurve, TopCurves, BottomCurves

fdm_toolpath_31 = FDMToolpath(Curve=fdm_vase_3.HelixCurve, EWidth=Slider(2, range=0..10))

# ----
# input should be a closed planar polyling
# output is a series of inner offsets
# first offset is 0.5*linewidth
# subsequent are n*linewidth
# infill curve is the inner most wall;
# area to be filled with infill
number_slider_20 = Slider(2, range=0..10)
# wall generation (different widths)
number_slider_21 = Slider(4, range=0..10)
# TOOLPATHS
# developed by JÜNGERKÜHN
# contact: toolpaths@juengerkuehn.com
# juengerkuehn.com
# github.com/KonradJuenger/TOOLPATHS
# CURVE GENERATION
# wall generation
geo_39 = Geometry(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)

fdm_walls_2 = FDMWallsGenerator(Curves=geo_39, LineWidth=number_slider_20, Count=number_slider_21, WallType=list)  # -> Curves, InfillCurves

geo_40 = Geometry(fdm_walls_2.Curves)
geo_41 = Geometry(fdm_walls_2.InfillCurves)
fdm_toolpath_32 = FDMToolpath(Curve=geo_40, EWidth=number_slider_20)

# ----
# manual offsets can be used to create walls with different thicknesses
# (right click to reveal the input)
# to get the offsets from linewidths:
# (Sum of all previous linewidths) + (Half of current linewidth)
linewidths = Panel("""1
2
1
1.5
2""")
geo_42 = Geometry(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)

ma = MassAddition(Input=linewidths)  # -> Result, PartialResults
_0_4 = Integer(0)
_2_12 = Integer(2)
division = Division(A=linewidths, B=_2_12)
ins = InsertItems(List=ma.PartialResults, Item=_0_4, Indices=_0_4, Wrap=True)
addition = Addition(A=ins, B=division)
short = ShortestList(ListA=addition, ListB=division, TrimMode=2)  # -> ListA, ListB

neg = Negative(Value=short.ListA)
fdm_walls_3 = FDMWallsGenerator(Curves=geo_42, LineWidth=1, Count=1, WallType=list_7, ManualOffsets=neg)  # -> Curves, InfillCurves

fdm_toolpath_33 = FDMToolpath(Curve=fdm_walls_3.Curves, EWidth=linewidths)

# ----
# variable layer heigh based on explicit values
# define a sequence of layerheights to interpolate
panel_5 = Panel("""1.7
0.3
1.7
0.3
1.7
0.3""")
_0_5 = Mode(0)
geo_43 = Geometry(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)

lh_field_3 = FDMLayerHeightField(
    Mode=_0_5,
    Heights=panel_5,
    MinimumHeight=0.1,
    RangeMax=0.4,
    TargetHeight=0.4,
    BeadWidth=0.8,
    MinimumOverlap=0.25,
    NormalizeRange=False)
fdm_vase_4 = FDMVaseModeGenerator(Geometry=geo_43, LayerHeight=1, LayerHeightField=lh_field_3, ExtrusionWidth=1.5, Options=vase_options)  # -> Toolpath, HelixCurve, UnsampledCurve, TopCurves, BottomCurves

fdm_toolpath_34 = FDMToolpath(Curve=fdm_vase_4.HelixCurve, EWidth=Slider(2, range=0..10))

# ----
# basic planar slicing
# create infill curves
# converting to a mesh
# results in faster slicing
input_geo = Geometry(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)
number_slider_22 = Slider(2, range=0..10)
vec_2 = Vector(Vector(9.385319152, 10.3421104, 0))

mesh = Mesh(input_geo)
planar_slice = FDMPlanarSliceGenerator(Geometry=mesh, LayerHeight=1, ExtrusionWidth=number_slider_22)  # -> Toolpaths, SliceCurves
fdm_walls_4 = FDMWallsGenerator(Curves=planar_slice.SliceCurves, LineWidth=number_slider_22, Count=Slider(2, range=0..10), WallType=list_2)  # -> Curves, InfillCurves

fdm_infill_3 = FDMInfillGenerator(InfillCurves=fdm_walls_4.InfillCurves, Direction=vec_2, InfillSpacing=2, MinLength=0, InfillType=list_4)
merge_9 = Merge(Data1=fdm_walls_4.Curves, Data2=fdm_infill_3)
# create toolpath object
fdm_toolpath_35 = FDMToolpath(Curve=merge_9, EWidth=Slider(2, range=0..10))

fdmcmd = FDMCommand(PauseSeconds=Slider(3, range=0..10))
fdmcmd_2 = FDMCommand(CustomGCode=" M800 ;custom gcode")
geo_44 = Geometry(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)

groupcmd = GroupCommands(Commands=[fdmcmd_2, fdmcmd])

fdm_toolpath_36 = FDMToolpath(Curve=geo_44, CommandsPre=groupcmd, CommandsPost=fdmcmd_2)

merge_10 = Merge(
    Data1=fdm_toolpath_7,
    Data2=fdm_toolpath_11,
    Data3=fdm_toolpath_8,
    Data4=fdm_toolpath_10,
    Data5=fdm_toolpath_12,
    Data6=fdm_toolpath_36,
    Data7=fdm_toolpath_14)

merge_11 = Merge(Data1=flatten(merge_3))
curve_gen = Merge(
    Data1=flatten(fdm_toolpath_32),
    Data2=flatten(fdm_toolpath_33),
    Data3=flatten(fdm_toolpath),
    Data4=flatten(fdm_toolpath_35),
    Data5=flatten(merge_7),
    Data6=flatten(fdm_toolpath_30),
    Data7=flatten(fdm_toolpath_34),
    Data8=flatten(fdm_toolpath_31))
toolpath_options = Merge(Data1=flatten(merge_2), Data3=flatten(merge), Data4=flatten(merge_10))

# ----
# extruder 1
number_slider_23 = Slider(1.5, range=0..10)
# Machine Settings
# process settings ( FDM Defaults) are seperated from fixed machine settings
# extruder 0
number_slider_24 = Slider(1.5, range=0..10)
_1_3 = Integer(1)
extruder = FDMExtruder(
    ExtruderNumber=_1_3,
    NozzleDiameter=number_slider_23,
    FilamentDiameter=Slider(1.75, range=0..10),
    PrintMaterial=ColourSwatch(SwatchColor=RGB(213, 113, 222)))

extruder_2 = FDMExtruder(
    ExtruderNumber=_0,
    NozzleDiameter=number_slider_24,
    FilamentDiameter=Slider(1.75, range=0..10),
    PrintMaterial=ColourSwatch(SwatchColor=RGB(90, 158, 242)))

machine_2 = FDMMachine(
    G0RapidSpeed=200,
    MaxZSpeed=6,
    Extruders=[extruder_2, extruder],
    EPosAbsRel=0,
    HomeBeforePrint=False,
    CenterPrintXY=False)

# ----
# "fdm machine"  takes all toolpaths and operations
# in input "T/O" and processes them.
mode_3 = ProcessorMode({"Hybrid": 2, "Preview": 1, "Simulation": 0}, selected="Hybrid")

# ----
# select machine type
# select a DIRECTORY to save the file
# by default it saves to the desktop
# upload works for klipper and reprap
# start printing after upload?
# path to a 3mf file used as a template bambu files
print_after_upload = BooleanToggle(False)
path = FilePath()
upload = Button()
ouput_gcode_to_gh = BooleanToggle(False)
save = Button()
path_2 = FilePath()

# ----
# Robot output
# orientation can be a simple constant xy plane,
# or pitch aglined, or tangentally aglined
# orientation can be applied to zhop moves
number_slider_25 = Slider(0, range=0..2)

# ----
# the path has 7 segments
# array mutiplies the toolpath 5 times
# as there are 7 segments and only 2 values
# the modulator has to map the values
# somehow to the segments.
# the options are:
# 0 constant -> 1 1 1 1 1 1 1
# 2 wrap -> 131313131
# 3 repeat last -> 1333333
# 4 normalized -> 1111333
# 5 interpolated -> 1 1.3 1.7 2 2.3 2.7 3
number_slider_26 = Slider(1, range=0..10)
geo_45 = Geometry(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)
# Vertex Mapping
explode = Explode(Curve=geo_45, Recursive=True)  # -> Segments, Vertices
lng = ListLength(List=explode.Segments)
fdm_toolpath_37 = FDMToolpath(Curve=geo_45, Volume=number_slider_26)
panel_6 = Panel(lng)
panel_7 = Panel("""0
2
3
4
5""")
# the modulator maps the supplied flow values
# (1 and 3)  to the segments of the toolpath
panel_8 = Panel("""1
3""")

Y = UnitY(Factor=4.808)
arrlinear_2 = LinearArray(Geometry=fdm_toolpath_37, Direction=Y, Count=5)  # -> Geometry, Transform

mod_flow_2 = ModulatorFlow(Input=arrlinear_2.Geometry, Scales=panel_8, VertexMappingStrategy=panel_7)

merge_12 = Merge(Data1=flatten(mod_flow), Data2=flatten(mod_flow_2))

# ----
# Normal Displacement 3D
geo_46 = Geometry(Point(124.3394153, 170.2310199, 0))
_10 = Number(10)
_18 = Number(18)
cyl_2 = Cylinder(Base=geo_46, Radius=_10, Length=_18)
panel_9 = Panel("""-1
-1
1
1""")
multiplication_2 = Multiplication(A=panel_9, B=Slider(0.55, range=0..1))

vase_options_5 = FDMVaseOptions(SamplingMode=mode, Divisions=Slider(46, range=0..100), BaseThickness=Slider(0.3, range=0..1))
fdm_vase_5 = FDMVaseModeGenerator(Geometry=cyl_2, LayerHeight=1, ExtrusionWidth=Slider(1.65, range=0..3), Options=vase_options_5)  # -> Toolpath, HelixCurve, UnsampledCurve, TopCurves, BottomCurves

mod_ndisp_2 = ModulatorNormalDisplacement(Input=fdm_vase_5.Toolpath, Distances=multiplication_2, VertexMappingStrategy=2, Mode=0)

merge_13 = Merge(Data1=flatten(mod_ndisp), Data2=flatten(mod_ndisp_2), Data3=flatten(mod_intervecfield))

merge_14 = Merge(Data1=flatten(merge_12), Data2=flatten(merge_13))

# ----
# combining masks
geo_47 = Geometry(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)
geo_48 = Geometry(Point(145.441354, 210.1205834, 8.658771264))
fdm_toolpath_38 = FDMToolpath(Curve=geo_47, EWidth=_2_9)
sph = Sphere(Base=geo_48, Radius=Slider(7, range=0..100))
sph_2 = Sphere(Base=geo_48, Radius=Slider(11, range=0..100))
num_2 = Number([0, 0, -2.11848, -2.11848])

maskregion = MaskFromRegion(
    Input=fdm_toolpath_38,
    RegionGeometry=sph_2,
    Invert=False,
    Falloff=0,
    CombinationModeEnabled=False,
    FalloffModeEnabled=False)
maskregion_2 = MaskFromRegion(
    Input=fdm_toolpath_38,
    RegionGeometry=sph,
    Invert=False,
    Falloff=0,
    CombinationModeEnabled=False,
    FalloffModeEnabled=False)

subtraction = Subtraction(A=maskregion, B=maskregion_2)
min = Minimum(A=maskregion, B=maskregion_2)
mod_ndisp_3 = ModulatorNormalDisplacement(Input=fdm_toolpath_38, Distances=num_2, VertexMappingStrategy=2, Mode=0, Mask=subtraction)

# ----
# masks are numbers
geo_49 = Geometry(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)
# mode: sphere create a shericial gradient around the point
number_slider_27 = Slider(5.01, range=0..100)
# mask are values. you can use math operations to modify them
fdm_toolpath_39 = FDMToolpath(Curve=geo_49, EWidth=_2_8)
geo_50 = Geometry(Point(95.09686967, 208.6346587, 10.30170012))

# ----
# the graph mapper can be used to sharpen the gradient
maskgradient = MaskGradient(Input=fdm_toolpath_39, Mode=1, Base=geo_50, Wavelength=number_slider_27, Wrap=1)

graph = GraphMapper(maskgradient, x0=0, x1=1, y0=0, y1=1, container_name="Bezier", cpx=[0, 1, 0.05815500394, 1], cpy=[0, 0, 1, 1])
mod_ndisp_4 = ModulatorNormalDisplacement(Input=fdm_toolpath_39, Distances=num, VertexMappingStrategy=2, Mode=0, Mask=graph)

# ----
# Mask from region
geo_51 = Geometry(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)
# an optional falloff creates a smooth transition
geo_52 = Geometry(Point(23.73628212, 210.6243736, 3.620420091))
# MASKS
fdm_toolpath_40 = FDMToolpath(Curve=geo_51, EWidth=_2_7)
# the region mask constrict the displacment with the sphere
toggle_3 = BooleanToggle(False)
num_3 = Number([-0.679, -0.679, 0.679, 0.679])

# ----
# inverting the mask flips the effect
cone = Cone(Base=geo_52, Radius=9, Length=16)  # -> Cone, Tip
# Masks are multipliers for Modulators.
# In the range 0..1 they act as a filter and lessen the effect of the modulator.
# For values larger 1 they can be used to increase the effect of a modulator.
cap = CapHoles(Brep=cone.Cone)
maskregion_3 = MaskFromRegion(
    Input=fdm_toolpath_40,
    RegionGeometry=cap,
    Invert=toggle_3,
    Falloff=Slider(0, range=0..4),
    CombinationModeEnabled=False,
    FalloffModeEnabled=False)

mod_ndisp_5 = ModulatorNormalDisplacement(Input=fdm_toolpath_40, Distances=num_3, VertexMappingStrategy=2, Mode=0, Mask=maskregion_3)

# ----
# Gradient mask
geo_53 = Geometry(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)
fdm_toolpath_41 = FDMToolpath(Curve=geo_53, EWidth=_2_10)
geo_54 = Geometry(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)
# gradient mask creates a ramp from 0..1
# based on a input geomerty and a period length
len = Length(Curve=geo_54)
num_4 = Number([-0.679, -0.679, 0.679, 0.679])

maskgradient_2 = MaskGradient(Input=fdm_toolpath_41, Mode=0, Base=geo_54, Wavelength=len)

mod_ndisp_6 = ModulatorNormalDisplacement(Input=fdm_toolpath_41, Distances=num_4, VertexMappingStrategy=2, Mode=0, Mask=maskgradient_2)

merge_15 = Merge(Data1=mod_ndisp_5, Data2=mod_ndisp_6, Data3=mod_ndisp_4, Data4=mod_ndisp_3)

# ----
# SETTINGS HIERARCHY
merge_16 = Merge(Data1=flatten(merge_15))
filter_3 = StreamFilter(
    Gate=list_8,
    Stream0=curve_gen,
    Stream1=toolpath_options,
    Stream2=merge_11,
    Stream3=curve_gen,
    Stream4=merge_14,
    Stream5=merge_16)

processor = FDMProcessor(Toolpaths=filter_3, Machine=machine_2, Defaults=filter_2, ProcessorMode=mode_3)  # -> SimulationData, Errors, Warnings

fdm_g_code = FDMGCodeOutput(
    SimulationData=processor.SimulationData,
    MachineType=machine,
    Save=save,
    Upload=upload,
    PrinterIPAddress="192.168.0.101",
    StartPrint=print_after_upload,
    OutputGCode=ouput_gcode_to_gh)  # -> GCode, Toolpath, Info, VerboseDebug, ToolpathDebug

fdm_sim = FDMSimulator(
    SimulationData=processor.SimulationData,
    Time=number_slider_16,
    Play=toggle_2,
    Speed=Slider(1, range=0.3..3),
    StadiumSegments=number_slider_15,
    BakeMeshes=toggle,
    Colors=colors,
    ProgressOverlay=True,
    DisablePreview=Toggle(False))  # -> CurrentTime, Meshes, ToolPosition, ProgramDuration

fdmrobot = FDMRobotsOutput(SimulationData=processor.SimulationData, Orientation=number_slider_25, Behavior=Slider(1, range=0..1))  # -> Planes, Speeds, Extrusion, ExtrusionSpeed, Types

panel_10 = Panel(fdm_sim.ProgramDuration)
mesh_2 = Mesh(fdm_sim.Meshes)
