# Grasshopper definition toolpath_simple_example-beta-22.gh (Grasshopper 1.0.8)
# plug-ins: Toolpaths.Fdm, Toolpaths.Gh

list = ValueList({"Offset": 0, "Spiral": 1}, selected="Offset")
list_2 = ValueList({"Monotonic": 0, "Monotonic (Connected)": 1, "Gyroid": 2, "Gyroid (Connected)": 3, "Spiral": 4}, selected="Monotonic (Connected)")
list_3 = ValueList({"Offset": 0, "Spiral": 1}, selected="Offset")
list_4 = ValueList({"Monotonic": 0, "Monotonic (Connected)": 1, "Gyroid": 2, "Gyroid (Connected)": 3, "Spiral": 4}, selected="Monotonic (Connected)")

defaults = FDMDefaults(
    HeightfieldResolution=Slider(0.3, range=0..1),
    SafeClearance=Slider(6, range=0..10),
    ZHopHeight=Slider(2, range=0..10),
    MeshingResolution=Slider(0.4, range=0..1),
    SmoothingWindow=Slider(1, range=0..100),
    DegenerateAspectRatio=Slider(2.723, range=0..10),
    MaxLayerHeight=Slider(3.072, range=0..10))

extruder = FDMExtruder(ExtruderNumber=0, NozzleDiameter=Slider(1.5, range=0..10), FilamentDiameter=1.75, PrintMaterial=RGB(100, 149, 237))
machine = FDMMachine(G0RapidSpeed=200, MaxZSpeed=6, Extruders=extruder, EPosAbsRel=0, HomeBeforePrint=False, CenterPrintXY=False)

mode = ProcessorMode({"Hybrid": 2, "Preview": 1, "Simulation": 0}, selected="Hybrid")

# ----
# increase the segement count to make the extrusion mesh rounder
number_slider = Slider(3, range=0..10)

# ----
# use the color componet to define custom colors
swatch = ColourSwatch(SwatchColor=RGB(90, 158, 242))
# Gcode output
swatch_2 = ColourSwatch(SwatchColor=RGB(252, 254, 255))
colors = Colors(FDMExtrusion=swatch, FDMTravel=swatch_2)

# ----
# use baking to output actual geometry to grasshopper. (slow)
toggle = BooleanToggle(False)

# ----
# SIMULATE + GCODE
# FDM simulator creates a scrubbable preview from all processed toolpaths
# playback controls
number_slider_2 = Slider(1, range=0..1)

mode_2 = ProcessorMode({"Hybrid": 2, "Preview": 1, "Simulation": 0}, selected="Hybrid")
machine_2 = Machine({"Klipper": "klipper", "RepRap": "reprap", "Prusa": "prusa", "Bambu": "bambu"}, selected="Klipper")

# ----
# planar slice for the first layers
geo = Geometry(Point(94.70520985, 24.6220849, 0))

# ----
# vase mode
xy = XYPlane(Origin=geo)
cyl = Cylinder(Base=xy, Radius=Slider(10, range=0..100), Length=Slider(23, range=0..100))

vase_options = FDMVaseOptions(BaseThickness=Slider(2.326, range=0..10))
fdm_vase = FDMVaseModeGenerator(Geometry=cyl, LayerHeight=1, ExtrusionWidth=1.5, Options=vase_options)  # -> Toolpath, HelixCurve, UnsampledCurve, TopCurves, BottomCurves
fdm_walls = FDMWallsGenerator(
    Curves=fdm_vase.BottomCurves,
    LineWidth=Slider(2, range=0..10),
    Count=1,
    WallType=list_3,
    ManualOffsets=Slider(0, range=0..0.01))  # -> Curves, InfillCurves
fdm_infill = FDMInfillGenerator(InfillCurves=fdm_walls.InfillCurves, InfillSpacing=2, MinLength=0, InfillType=list_4)

merge = Merge(Data1=fdm_vase.HelixCurve, Data2=fdm_walls.Curves, Data3=fdm_infill)
fdm_toolpath = FDMToolpath(Curve=merge, EWidth=Slider(2, range=0..10))

# ----
# create infill curves
# converting to a mesh
# results in faster slicing
input_geo = Geometry(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)

# ----
# TOOLPATHS
# developed by JÜNGERKÜHN
# contact: toolpaths@juengerkuehn.com
# juengerkuehn.com
# github.com/KonradJuenger/TOOLPATHS
mesh = Mesh(input_geo)
planar_slice = FDMPlanarSliceGenerator(Geometry=mesh, LayerHeight=1, ExtrusionWidth=1.5)  # -> Toolpaths, SliceCurves
fdm_walls_2 = FDMWallsGenerator(Curves=planar_slice.SliceCurves, LineWidth=1, Count=1, WallType=list)  # -> Curves, InfillCurves
fdm_infill_2 = FDMInfillGenerator(InfillCurves=fdm_walls_2.InfillCurves, InfillSpacing=2, MinLength=0, InfillType=list_2)  # -> Curves, Diagnostics

merge_2 = Merge(Data1=fdm_walls_2.Curves, Data2=fdm_infill_2.Curves)
# create toolpath object
fdm_toolpath_2 = FDMToolpath(Curve=merge_2, EWidth=Slider(2, range=0..10))

merge_3 = Merge(Data1=flatten(fdm_toolpath_2), Data2=flatten(fdm_toolpath))
processor = FDMProcessor(Toolpaths=merge_3, Machine=machine, Defaults=defaults, ProcessorMode=mode)  # -> SimulationData, Errors, Warnings

# ----
# select machine type
# select a DIRECTORY to save the file
# by default it saves to the desktop
# upload works for klipper and reprap
# start printing after upload?
# path to a 3mf file used as a template bambu files
print_after_upload = BooleanToggle(False)
path = FilePath()
upload = Button()
ouput_gcode_to_gh = BooleanToggle(False)
path_2 = FilePath()
save = Button()
fdm_g_code = FDMGCodeOutput(
    SimulationData=processor.SimulationData,
    MachineType=machine_2,
    Save=save,
    Upload=upload,
    PrinterIPAddress="192.168.0.101",
    StartPrint=print_after_upload,
    OutputGCode=ouput_gcode_to_gh)  # -> GCode, Toolpath, Info, VerboseDebug, ToolpathDebug

fdm_sim = FDMSimulator(
    SimulationData=processor.SimulationData,
    Time=number_slider_2,
    Play=Toggle(False),
    Speed=Slider(1, range=0.3..3),
    StadiumSegments=number_slider,
    BakeMeshes=toggle,
    Colors=colors,
    ProgressOverlay=True,
    DisablePreview=False)  # -> CurrentTime, Meshes, ToolPosition, ProgramDuration
mesh_2 = Mesh(fdm_sim.Meshes)
panel = Panel(fdm_g_code.Info)
panel_2 = Panel(fdm_sim.ProgramDuration)
