# Grasshopper definition toolpath_variable_infill-beta6.gh (Grasshopper 1.0.8)
# plug-ins: Toolpaths.Fdm, Toolpaths.Gh

# ----
# base geometry
number_slider = Slider(20, range=0..100)
# TOOLPATHS
# developed by JÜNGERKÜHN
# contact: toolpaths@juengerkuehn.com
# juengerkuehn.com
# github.com/KonradJuenger/GH_toolpaths
xy = XYPlane(Origin=Point(0, 0, 0))
cyl = Cylinder(Base=xy, Radius=number_slider, Length=Slider(14, range=0..100))

# ----
# create planar slice curves
number_slider_2 = Slider(0.4, range=0..1)
planar_slice = FDMPlanarSliceGenerator(Geometry=cyl, LayerHeight=number_slider_2, MaxSegmentLength=0.3)

number_slider_3 = Slider(0.39, range=0..1)
# create walls
number_slider_4 = Slider(2, range=0..10)
neg = Negative(Value=number_slider_3)
fdm_walls = FDMWallsGenerator(Curves=planar_slice, LineWidth=number_slider_4, Count=Slider(1, range=0..10), InfillOffset=number_slider_3)  # -> Curves, InfillCurves

# ----
# create infill curves
X = UnitX(Factor=1)
Y = UnitY(Factor=1)
merge = Merge(Data1=Y, Data2=X)
# alternating slicing direction
long = LongestList(ListA=flatten(fdm_walls.InfillCurves), ListB=merge, PaddingMode=4)  # -> ListA, graft(ListB)
match = MatchTree(Tree=long.ListB, Guide=fdm_walls.InfillCurves)

neg_2 = Negative(Value=Slider(0.7, range=0..1))

list = ValueList({"Monotonic": 0, "Monotonic (Connected)": 1}, selected="Monotonic")
# create infill
fdm_infill = FDMInfillGenerator(
    InfillCurves=fdm_walls.InfillCurves,
    Direction=match,
    LineWidth=Slider(4, range=0..10),
    MinLength=0,
    InfillType=list,
    ManualOffset=neg_2)

# ----
# create more control points for mapping flow values onto
number_slider_5 = Slider(1, range=0..1)
curvedivide = CurveDivider(Curves=fdm_infill, SegmentLength=number_slider_5, SubdividePolylines=Toggle(True))

# ----
# walls with 2mm width
number_slider_6 = Slider(2, range=0..10)
fdm_toolpath = FDMToolpath(Curve=fdm_walls.Curves, EWidth=number_slider_6)

# ----
# initial volumetic flow
number_slider_7 = Slider(1.1, range=0..10)
fdm_toolpath_2 = FDMToolpath(Curve=curvedivide, Volume=number_slider_7)

# ----
# modulate flow
panel = Panel("""1
1
0.5
0.5
0.5
1
1""")
mod_flow = ModulatorFlow(Input=fdm_toolpath_2, Scales=panel, VertexMappingStrategy=Slider(5, range=0..10))

# ----
# combine walls and infill
merge_2 = Merge(Data1=fdm_toolpath, Data2=mod_flow)
fdmdefaults = FDMDefaults(
    HeightfieldResolution=Slider(0.1, range=0..1),
    InitZHeight=Slider(6, range=0..10),
    ZHopHeight=Slider(0.2, range=0..1),
    NozzleDiameter=Slider(1.5, range=0..10),
    MeshingResolution=Slider(0.3, range=0..1),
    SmoothingWindow=Slider(5, range=0..100),
    DegenerateAspectRatio=Slider(20, range=0..100),
    MaxLayerHeight=Slider(4.443, range=0..10))
fdm_machine = FDMMachine(ToolpathsOperations=merge_2, Defaults=fdmdefaults, HFTime=-1, DebugOutputs=False)  # -> SimulationData, Errors, Warnings, HFPoints, SamplePoints, SampleHeights, TripleProbeTree

# ----
# increase the segement count to make the extrusion mesh rounder
number_slider_8 = Slider(3, range=0..10)

# ----
# use the color componet to define custom colors
swatch = ColourSwatch(SwatchColor=RGB(90, 158, 242))
colors = Colors(FDMExtrusion=swatch, FDMTravel=ColourSwatch(SwatchColor=RGB(252, 254, 255)))

# ----
# use baking to output actual geometry to grasshopper. (slow)
toggle = BooleanToggle(False)

# ----
# SIMULATE + GCODE
# playback controls
number_slider_9 = Slider(1, range=0..1)
fdm_sim = FDMSimulator(
    SimulationData=fdm_machine.SimulationData,
    Time=number_slider_9,
    Play=Toggle(False),
    Speed=Slider(1, range=0.3..3),
    StadiumSegments=number_slider_8,
    BakeMeshes=toggle,
    Colors=colors)  # -> CurrentTime, Meshes, ToolPosition

# ----
# Gcode output
# select machine type
# select a DIRECTORY to save the file
# by default it saves to the desktop
# upload works for klipper and reprap
# start printing after upload?
# path to a 3mf file used as a template bambu files
machine = Machine({"Klipper": "klipper", "RepRap": "reprap", "Prusa": "prusa", "Bambu": "bambu"}, selected="Klipper")
path = FilePath()
path_2 = FilePath()
fdm_g_code = FDMGCodeOutput(
    SimulationData=fdm_machine.SimulationData,
    MachineType=machine,
    Save=Button(),
    Upload=Button(),
    PrinterIPAddress="192.168.0.101",
    StartPrint=Toggle(False),
    Template3MF=path_2)  # -> GCode, Toolpath, Info, VerboseDebug, ToolpathDebug

mesh = Mesh(fdm_sim.Meshes)
