# Grasshopper definition toolpath_vectorFieldModulator-beta-20.gh (Grasshopper 1.0.8)
# plug-ins: Toolpaths.Fdm, Toolpaths.Gh

mode = SamplingMode(0)

# ----
# vase mode spiral path
# minimum layer height for spiral path
number_slider = Slider(88, range=0..1000)
planar_layer = Slider(3, range=0..10)
spiral_offset = Slider(0.2, range=0..1)
layerheigt = Slider(4, range=0..10)
# TOOLPATHS
# developed by JÜNGERKÜHN
# contact: toolpaths@juengerkuehn.com
# juengerkuehn.com
# github.com/KonradJuenger/TOOLPATHS
geo = Geometry(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)
multiplication = Multiplication(A=layerheigt, B=planar_layer)
addition = Addition(A=multiplication, B=spiral_offset)
fdm_vase = FDMVaseModeGenerator(
    Geometry=geo,
    LayerHeight=layerheigt,
    InferAxis=False,
    BaseThickness=addition,
    SamplingMode=mode,
    SamplingDistance=1,
    Divisions=number_slider,
    StaggerCycle=1,
    PitchMode=0)  # -> HelixCurve, UnsampledCurve, TopCurves, BottomCurves

wall_width = Slider(8, range=0..10)

# ----
# vase mode constucts the toolpath on the surface,
# walls generator applies a 0.5*widths offset by default.
# 
# -> we use manual offset: 0, width to align
# vase mode and wall toolpath
_0 = Number(0)
merge = Merge(Data1=_0, Data2=wall_width)

panel = Panel(merge)
neg = Negative(Value=merge)
fdm_walls = FDMWallsGenerator(Curves=fdm_vase.BottomCurves, LineWidth=1, Count=1, ManualOffsets=neg)  # -> Curves, InfillCurves

# ----
# planar layers: walls toolpath
_2 = Number(2)
e_mode = EMode({"Volume": 0, "Auto Width": 1, "Auto Ratio": 2, "Static": 3, "No Extrusion": 4}, selected="Auto Width")
fdm_toolpath = FDMToolpath(Curve=fdm_walls.Curves, EMode=e_mode, EWidth=wall_width)

X = UnitX(Factor=1)
Y = UnitY(Factor=1)
merge_2 = Merge(Data1=Y, Data2=X)  # -> flatten(Result)
long = LongestList(ListA=flatten(fdm_walls.InfillCurves), ListB=merge_2, PaddingMode=4)  # -> ListA, graft(ListB)
match = MatchTree(Tree=long.ListB, Guide=fdm_walls.InfillCurves)

list = ValueList({"Monotonic": 0, "Monotonic (Connected)": 1, "Gyroid": 2, "Gyroid (Connected)": 3, "Spiral": 4}, selected="Monotonic (Connected)")
fdm_infill = FDMInfillGenerator(InfillCurves=fdm_walls.InfillCurves, Direction=match, InfillSpacing=wall_width, MinLength=0, InfillType=list)

# ----
# main spiral "vase mode" toolpath
e_mode_2 = EMode({"Volume": 0, "Auto Width": 1, "Auto Ratio": 2, "Static": 3, "No Extrusion": 4}, selected="Auto Width")
fdm_toolpath_2 = FDMToolpath(Curve=fdm_vase.HelixCurve, EMode=e_mode_2, EWidth=wall_width)

# ----
# planar layers: infill
e_mode_3 = EMode({"Volume": 0, "Auto Width": 1, "Auto Ratio": 2, "Static": 3, "No Extrusion": 4}, selected="Auto Width")
fdm_toolpath_3 = FDMToolpath(Curve=fdm_infill, EMode=e_mode_3, EWidth=wall_width)

vec = Vector(Vector(0, 0, -100))
# vase mode toolpath into non-planar transform
geo_2 = Geometry(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)
move = Move(Geometry=geo_2, Motion=vec)  # -> Geometry, Transform
merge_3 = Merge(Data1=geo_2, Data2=move.Geometry)
divide = DivideCurve(Curve=merge_3, Count=Slider(8, range=0..10), Kinks=False)  # -> Points, Tangents, Parameters

Z = UnitZ(Factor=1)
neg_2 = Negative(Value=Z)
merge_4 = Merge(Data1=Z, Data2=neg_2)
long_2 = LongestList(ListA=divide.Points, ListB=merge_4, PaddingMode=4)  # -> ListA, ListB

panel_2 = Panel("""0
1""")
shift = ShiftList(List=long_2.ListB, Shift=graft(panel_2), Wrap=True)  # -> flatten(List)

amp = Amplitude(Vector=shift, Amplitude=Slider(8, range=0.1..8))

_0_linear = Wrap(0)

extruder = FDMExtruder(ExtruderNumber=0, NozzleDiameter=Slider(6, range=0..10), FilamentDiameter=1.75, PrintMaterial=RGB(100, 149, 237))
machine = FDMMachine(G0RapidSpeed=200, MaxZSpeed=6, Extruders=extruder, EPosAbsRel=0, HomeBeforePrint=False, CenterPrintXY=False)

defaults = FDMDefaults(
    HeightfieldResolution=Slider(0.3, range=0..1),
    SafeClearance=Slider(6, range=0..10),
    ZHopHeight=Slider(2, range=0..10),
    MeshingResolution=Slider(0.5, range=0..1),
    SmoothingWindow=Slider(1, range=0..100),
    DegenerateAspectRatio=Slider(20, range=0..100),
    MinLayerHeight=Slider(0.1, range=0..0.1),
    MaxLayerHeight=Slider(4.4, range=0..10))

# ----
# use baking to output actual geometry to grasshopper. (slow)
toggle = BooleanToggle(False)

# ----
# use the color componet to define custom colors
swatch = ColourSwatch(SwatchColor=RGB(90, 158, 242))
colors = Colors(FDMExtrusion=swatch, FDMTravel=ColourSwatch(SwatchColor=RGB(252, 254, 255)))

# ----
# increase the segement count to make the extrusion mesh rounder
number_slider_2 = Slider(3, range=0..10)

# ----
# FDM simulator
number_slider_3 = Slider(0, range=0..1)

# ----
# preview vectors
# create base points
# displace toolpath with vector field modulator
# extend of influce of each vector
# global strength
# set vec strength
# alternate vectors
# create matching up/ down vectors
# create a mask
# to preserve the first layers
pt = Point(flatten(divide.Points))
fdmtp = FDMToolpath(fdm_toolpath_2)
pt_2 = Point(pt)
vec_2 = Vector(amp)

avr = Average(Input=pt)
scale = Scale(Geometry=pt, Center=avr, Factor=1.1)  # -> Geometry, Transform
vdis = VectorDisplay(Anchor=scale.Geometry, Vector=shift)

geo_3 = Geometry(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)
len = Length(Curve=geo_3)
_2_clamp = Wrap(2)
maskgradient = MaskGradient(Input=fdmtp, Mode=_0_linear, Base=geo_3, Wavelength=len, Wrap=_2_clamp)

mod_intervecfield = ModulatorInterpolatedVectorField(
    Input=fdmtp,
    Points=pt_2,
    Vectors=vec_2,
    Sigma=Slider(90, range=0..100),
    Strength=Slider(1, range=0..2),
    Mask=maskgradient)

# ----
# merge all toolpaths
merge_5 = Merge(Data1=mod_intervecfield, Data2=fdm_toolpath, Data3=fdm_toolpath_3)
processor = FDMProcessor(Toolpaths=merge_5, Machine=machine, Defaults=defaults, HFTime=-1, DebugOutputs=False)  # -> SimulationData, Errors, Warnings, HFPoints, SamplePoints, SampleHeights, TripleProbeTree
fdm_sim = FDMSimulator(
    SimulationData=processor.SimulationData,
    Time=number_slider_3,
    Play=Toggle(False),
    Speed=1,
    StadiumSegments=number_slider_2,
    BakeMeshes=toggle,
    Colors=colors,
    ProgressOverlay=True,
    DisablePreview=Toggle(False))  # -> CurrentTime, Meshes, ToolPosition, ProgramDuration
